# Grasshopper definition 210126_T2_master_weiting.ghx (Grasshopper 1.0.7)
# plug-ins: Kangaroo2 Components

# ---- group: 2021021
# Input curves
scan_points = Point(Tree({0;0;0;0}: [Point(0.5010593336, 1.712094155, 0.6523001851), Point(0.4924715612, 1.711910877, 0.6673449224), Point(0.4822746341, 1.709717777, 0.6862463322), Point(0.4696434999, 1.706941537, 0.7100002064), Point(0.4543929041, 1.702988825, 0.7374317327), Point(0.4154378795, 1.694906469, 0.8008200656)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], {0;1;0;0}: [Point(0.2805780484, 2.274035175, 2.391582765), Point(0.2795859767, 2.273718151, 2.380341144), Point(0.2559206153, 2.272027282, 2.358331968), Point(0.2449302819, 2.27070268, 2.348656341), Point(0.2328960286, 2.26631569, 2.337957799), Point(0.2177713331, 2.262053703, 2.326534615)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]))
scan_frames = Plane(Tree({0;0;0}: [Plane(origin=(0.5010593336, 1.712094155, 0.6523001851), x=(0.1640375906, -0.9849720002, 0.05405393225), y=(-0.00801073336, 0.05346428526, 0.9985376299)), Plane(origin=(0.4924715612, 1.711910877, 0.6673449224), x=(0.1668180016, -0.9848806747, 0.04670985908), y=(-0.02734595057, 0.0427340175, 0.9987121721)), Plane(origin=(0.4822746341, 1.709717777, 0.6862463322), x=(0.1624834087, -0.9859860195, 0.03782474378), y=(-0.04792314359, 0.03040313148, 0.998388212)), Plane(origin=(0.4696434999, 1.706941537, 0.7100002064), x=(0.1605869312, -0.9866028124, 0.02875288029), y=(-0.07321771104, 0.01714333515, 0.9971686281)), Plane(origin=(0.4543929041, 1.702988825, 0.7374317327), x=(0.1563365993, -0.9875659113, 0.01650571405), y=(-0.09826847292, 0.001076238983, 0.9951593586)), Plane(origin=(0.4154378795, 1.694906469, 0.8008200656), x=(0.1609009723, -0.9869250994, 0.009472343578), y=(-0.1531651567, -0.0154874941, 0.9880792338))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], {0;1;0}: [Plane(origin=(0.2805780484, 2.274035175, 2.391582765), x=(0.2004197664, -0.9797096199, -0.0009888775235), y=(-0.9453629537, -0.1936581729, 0.2622697045)), Plane(origin=(0.2795859767, 2.273718151, 2.380341144), x=(0.2139958975, -0.9768049405, 0.007606838929), y=(-0.939964396, -0.2037932006, 0.273743065)), Plane(origin=(0.2559206153, 2.272027282, 2.358331968), x=(0.2530042038, -0.9667520727, 0.03713896486), y=(-0.934528813, -0.2342796007, 0.2678973056)), Plane(origin=(0.2449302819, 2.27070268, 2.348656341), x=(0.2612307318, -0.9637383214, 0.05446974083), y=(-0.9341661517, -0.2381978658, 0.265697907)), Plane(origin=(0.2328960286, 2.26631569, 2.337957799), x=(0.2816190353, -0.9580723528, 0.05280232795), y=(-0.9282336788, -0.2580828351, 0.267909477)), Plane(origin=(0.2177713331, 2.262053703, 2.326534615), x=(0.2858000716, -0.955732734, 0.06995184224), y=(-0.9312929781, -0.2598032694, 0.2553343889))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]))

# ---- group: scan_canvas
input_frame_points = Point([Point(0.3967918493, 2.516562405, 2.480770997), Point(0.3963891959, 2.51667309, 2.481021419), Point(0.3955820455, 2.516276329, 2.481269018), Point(0.3954014651, 2.516510611, 2.481007222), Point(0.3957817517, 2.515954674, 2.480660489), Point(0.3957817517, 2.515954674, 2.480660489)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])
cullpt = CullDuplicates(Points=input_frame_points, Tolerance=0.1, CullMode=3)  # -> Points, Indices, Valence
item = ListItem(List=cullpt.Points, Index=0, Wrap=True)  # -> Item, Item1, Item2
rec_3pt = Rectangle3Pt(PointA=item.Item, PointB=item.Item1, PointC=item.Item2)  # -> Rectangle, Length
boundary = BoundarySurfaces(Edges=rec_3pt.Rectangle)

# ----
python = GhPythonScript(input_planes=simplify(scan_frames), rebuild=Toggle(True))  # -> out, new_points, new_planes; inputs input_planes: tree of Plane
# ---------- python: Python ----------
__author__ = "WeiTingChen"
ghenv.Component.Message = "rebuild by params"

import Rhino.Geometry as rg
import ghpythonlib.components as ghc
import ghpythonlib.treehelpers as th

input_planes_list = [list(b) for b in input_planes.Branches]

def getPointsByRefcurves(points, curves):
    """ This function is to rebuild curves by reference curves and initial points
    return points 
    """
    crv_domain = rg.Interval(0.0,1.0)
    rebuild_curves = []
    for c in curves:
        c.Domain  = crv_domain
        rebuild_curve = c.Rebuild(50, 3, True)
        rebuild_curve.Domain = crv_domain
        rebuild_curves.append(rebuild_curve)
    new_points = []
    
    for i in range (len(curves)):
        new_point_row = []
        for j in range(len(points[i])):
            param = curves[i].ClosestPoint(points[i][j], 1000)[1]
            new_point = rebuild_curves[i].PointAt(param) 
            new_point_row.append(new_point)
        new_points.append(new_point_row)
    return new_points

def changePlaneOrigin(planes, refPoints):
    new_planes = []
    for plane, point in zip(planes, refPoints) :
        new_plane = rg.Plane(point, plane.XAxis, plane.YAxis)
        new_planes.append(new_plane)
    return new_planes



if rebuild:
    # x = [[j for j in range(5)] for i in range(5)]
    record_points = [[p.Origin for p in input_planes_list[i]] for i in range(len(input_planes_list))]
    record_curves = [rg.NurbsCurve.Create(False, 3, row) for row in record_points]
    new_points = getPointsByRefcurves(record_points, record_curves)
    new_planes = [[changePlaneOrigin(input_planes_list[i], new_points[i])] for i in range(len(input_planes_list))]
    
else:
    pass



## list to gh_tree
new_points = th.list_to_tree(new_points)
new_planes = th.list_to_tree(new_planes)
# ---------- end python ----------
intcrv = Interpolate(Vertices=python.new_points, Degree=3, Periodic=False, KnotStyle=1)  # -> Curve, Length, Domain
list = ValueList({"normal": 1, "flip": -1}, selected="normal")
list_2 = ValueList({"normal": 1, "flip": -1}, selected="normal")
list_3 = ValueList({"normal": True, "flip": False}, selected="flip")
python_2 = GhPythonScript(surface=boundary, direcX=list, direcY=list_2, direcZ=list_3)  # -> out, new_plane
# ---------- python_2: Python ----------
__author__ = "WeiTingChen"
ghenv.Component.Message = ""

import Rhino.Geometry as rg
import ghpythonlib.components as ghc
import ghpythonlib.treehelpers as th

bool, plane = ghc.IsPlanar(surface, True)


# create new plane

new_plane = rg.Plane(plane.Origin, plane.XAxis*direcX, plane.YAxis*direcY)

if direcZ:
    new_plane.Flip()
else:
    pass
# ---------- end python_2 ----------
dividebycount = DividebyCount(crv=intcrv.Curve, N=Slider(15, range=0..100))  # -> P, F
python_3 = GhPythonScript(input_points=simplify(dividebycount.P), ref_plane=python_2.new_plane, ref_projected_plane=simplify(python_2.new_plane))  # -> out, projected_planes, a; inputs input_points: list of Point3d, ref_plane: Plane, ref_projected_plane: list of Plane
# ---------- python_3: Python ----------
__author__ = "WeiTingChen"
ghenv.Component.Message = ""

import Rhino.Geometry as rg
import ghpythonlib.components as ghc
import ghpythonlib.treehelpers as th
import design_filter.utilities.util as u
reload(u)



projected_points = u.projectionToPlane(input_points, ref_plane)
projected_planes = u.changePlaneOrigin(ref_projected_plane, projected_points)
# ---------- end python_3 ----------
crv = Curve([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])
crv_2 = Curve(crv)
list_4 = ValueList({"normal": 1, "flip": -1}, selected="normal")
list_5 = ValueList({"normal": 1, "flip": -1}, selected="normal")
list_6 = ValueList({"normal": True, "flip": False}, selected="normal")
dividebycount_2 = DividebyCount(crv=crv_2, N=Slider(10, range=0..100))  # -> P, F
number_slider = Slider(1000, range=0..1000)
ref_plane = Plane(python_2.new_plane)
X = UnitX(Factor=Slider(600, range=0..1000))
filtered_curve = Curve(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)
multiple_filtered_curves = Curve(Tree({0;0;0;0;0;0}: [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], {0;0;0;0;0;1}: [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], {0;0;0;0;0;2}: [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]))
_201211_2m_panel = Curve(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)
_201215_3m_panel = Curve(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)
_201218_3m_panel = Curve([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])
_201222_2m_panel = Curve([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])

move_axis_in_z = Slider(177, range=0..2000)
move_target_mesh_in_y = Slider(187, range=-500..500)
distance_from_axis_to_target_mesh = Panel("1300")
move_axis_in_x = Slider(671, range=0..1000)
target_mesh_height = Panel("1800")
# Fabrication Setup
# Target Geometry
rümlang_robot_positions = Geometry([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])
target_mesh_width = Panel("1250")
list_7 = ValueList({"RFL": 0, "Rümlang": 1}, selected="RFL")
axis_setting = Axis_setting(
    G=list_7,
    x=move_axis_in_x,
    A=move_axis_in_z,
    Y=target_mesh_height,
    A_3=distance_from_axis_to_target_mesh,
    F=move_target_mesh_in_y,
    A_2=target_mesh_width)  # -> env, targetmesh, boundingbox
mesh = Mesh(axis_setting.targetmesh)
preview = CustomPreview(Geometry=axis_setting.env, Shader=ColourSwatch(SwatchColor=RGBA(166, 166, 166, 45)))

testcrv = Curve(Tree({0;0;0;0;0}: [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], {0;0;0;1;0}: [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], {0;0;0;2;0}: [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], {0;0;0;3;0}: [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], {0;0;0;4;0}: [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], {0;0;0;5;0}: [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]))
crv_3 = Curve(flatten(testcrv))
crv_4 = Curve()
move = Slider(-0.04, range=-0.5..0.5)

pt = Point([Point(0.7972136119, 2.472970463, 0.6951917546), Point(0.8063400101, 2.474861921, 0.6949005067), Point(0.8247799995, 2.47399885, 0.6935059353), Point(0.8311133206, 2.472043463, 0.6918136599), Point(0.8349328164, 2.469890274, 0.6907712471)])
stored_areapoints = Point([Point(0.7238301035, 2.408431428, 2.314534607), Point(0.7288590992, 2.411112571, 2.315387496), Point(0.7434943031, 2.414522053, 2.317306733), Point(0.7487954338, 2.413529782, 2.318997115), Point(0.7537339471, 2.409851135, 2.321686563), Point(0.8689236796, 1.119590581, 0.5110107409)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])
pt_2 = Point([Point(0.7238301035, 2.408431428, 2.314534607), Point(0.7288590992, 2.411112571, 2.315387496), Point(0.7434943031, 2.414522053, 2.317306733), Point(0.7487954338, 2.413529782, 2.318997115), Point(0.7537339471, 2.409851135, 2.321686563), Point(0.7238301035, 2.408431428, 2.314534607), Point(0.7368369762, 2.41405088, 2.316393922), Point(0.7434943031, 2.414522053, 2.317306733), Point(0.7487954338, 2.413529782, 2.318997115), Point(0.7537339471, 2.409851135, 2.321686563)])
pt_3 = Point([Point(1.009324789, 1.295676426, 0.63515835), Point(1.014504619, 1.297370934, 0.6317527445), Point(1.019712194, 1.298998524, 0.6330188046)])
pt_4 = Point([Point(0.8770808224, 1.361034878, 2.25789264), Point(0.8840833665, 1.357835747, 2.263621924), Point(0.8923531529, 1.355129177, 2.268842383), Point(0.8974493308, 1.351393321, 2.279983591)])
python_4 = GhPythonScript(points1=pt_2, p2=pt_4, p3=pt, p4=pt_3)  # -> out, area_points; inputs points1: list of Point3d, p2: list of Point3d, p3: list of Point3d, p4: list of Point3d
# ---------- python_4: Python ----------
import Rhino.Geometry as rg
##to delete
area_points=[]

area_points.append(points1)
area_points.append(p2)
area_points.append(p3)
area_points.append(p4)
# ---------- end python_4 ----------

Y = UnitY(Factor=move)
divide = DivideCurve(Curve=testcrv, Count=Slider(20, range=0..100), Kinks=False)  # -> Points, Tangents, Parameters
crv_5 = Curve([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])
move_2 = Move(Geometry=testcrv, Motion=Y)  # -> simplify(Geometry), Transform
crv_6 = Curve(flatten(move_2.Geometry))
pt_5 = Point(Point(0, 0, 0))
activate = BooleanToggle(False)
export = BooleanToggle(False)
# Camera Position
panel = Panel("-280, 0, 350")

dom = ConstructDomain(DomainStart="400", DomainEnd="500")

run = BooleanToggle(True)

# ----
# Load .ply
# To start the proxy server:
# - Start Ananconda Promt (as admin)
# - Run:
# from compas.rpc import Proxy
# p = Proxy()
start_proxy = BooleanToggle(False)
type = ValueList({"mesh"}, selected="mesh")
py = GhPythonScript()  # -> ply_source
# ---------- py: Python ----------
import os
import sys

filepath = ghenv.Component.Attributes.Owner.OnPingDocument().FilePath
path = os.path.abspath(os.path.join(filepath, "..", "..", ".."))
print(path)

ply_source = os.path.abspath(os.path.join(path, "data/ply"))
# ---------- end py ----------
panel_2 = Panel(py)
export_ply = GhPythonScript(activate=activate, start_proxy=start_proxy, export=export, path=panel_2, type=type)  # -> out
# ---------- export_ply: Python ----------
from compas_ghpython import unload_modules
unload_modules('robotic_plaster_spraying.depthscan')
from compas.rpc import Proxy
import os

filename = os.path.join(os.path.abspath(path), 'scan.ply')
print filename

if activate:
    if start_proxy:
        depthscan = Proxy('robotic_plaster_spraying.depthscan')
    else:
        Proxy.stop_server(depthscan)
    if export:
        if type == "mesh":
            filename = os.path.join(os.path.abspath(path), 'scan.ply')
            depthscan.export(filename, mesh=True, pc=False)
        if type == "pointcloud":
            filename = os.path.join(os.path.abspath(path), 'pc.ply')
            depthscan.export(filename, mesh=False, pc=True)
# ---------- end export_ply ----------
path = PythonScript(path=panel_2)  # -> data
# ---------- path: Python ----------
import os

data = os.path.join(os.path.abspath(path), 'scan.ply')
# ---------- end path ----------
import_scan = PythonScript(run=run, data=path)  # -> out, mesh
# ---------- import_scan: Python ----------
from compas.datastructures import Mesh
from compas_ghpython.artists import MeshArtist

if run:
    scanned_surface = Mesh.from_ply(data)
    artist = MeshArtist(scanned_surface)
    
    mesh = artist.draw()
# ---------- end import_scan ----------
process_mesh = Process_mesh(box=axis_setting.boundingbox, G=import_scan.mesh, pt=panel)
# Process Control
mesh_2 = Mesh(process_mesh)

# ----
# Read JSON
panel_3 = Panel("210122_2m_Panel_Fabrication_Parameters.json")
py_2 = GhPythonScript()  # -> json_source
# ---------- py_2: Python ----------
import os
import sys

filepath = ghenv.Component.Attributes.Owner.OnPingDocument().FilePath
path = os.path.abspath(os.path.join(filepath, "..", "..", ".."))
print(path)

json_source = os.path.abspath(os.path.join(path, "data/json/210122_Test_Loading_Fabrication_Parameters"))
# ---------- end py_2 ----------
panel_4 = Panel(py_2)
read = GhPythonScript(
    file_path=panel_4,
    fab_parameters_filename=panel_3,
    mesh_filename="210122_2m_Panel_Base_Mesh_0.json",
    load_mesh=Toggle(True),
    load_fab_parameters=Toggle(True),
    reverse_vol=Toggle(False))  # -> out, mesh, close_mesh, target_pts_out, velocity_list_out, Ed_list_out, overall_setting_out; inputs load_mesh: Boolean, reverse_vol: Boolean
# ---------- read: Python ----------
import os
import json
import Rhino.Geometry as rg
import ghpythonlib.treehelpers as th
from compas.datastructures import Mesh
from compas_ghpython.artists import MeshArtist
from robotic_plaster_spraying.utilities_fabrication import data_gathering
reload(data_gathering)
from robotic_plaster_spraying.utilities_fabrication import projection
reload(projection)

if load_mesh:
    c_mesh = Mesh.from_json(os.path.join(file_path, mesh_filename))

    artist = MeshArtist(c_mesh)
    mesh = artist.draw()
    
    close_mesh = projection.CapMesh(c_mesh, reverse = reverse_vol)
    
    artist = MeshArtist(close_mesh)
    close_mesh = artist.draw()

if load_fab_parameters:
    fabrication_parameters = data_gathering.ReadDictFromJson(os.path.join(file_path, fab_parameters_filename))
    
    path = []
    velocity_list = []
    Ed_list = []
    overall_setting = []
    
    for i in range(len(fabrication_parameters)):
        branch = []
        Ed = []
        velocity = []
        for j in range(len(fabrication_parameters['%d' % i])):
            if i == 0 and j == 0:
                overall_setting.extend([fabrication_parameters['%d' % i]['%d' % j]['pump_speed'],
                                        fabrication_parameters['%d' % i]['%d' % j]['air_pressure'],
                                        fabrication_parameters['%d' % i]['%d' % j]['custom_layer_num']
                                       ])
                branch.append(rg.Point3d(*fabrication_parameters['%d' % i]['%d' % j]['xyz']))
                Ed.append(fabrication_parameters['%d' % i]['%d' % j]['Ed'])
                velocity.append(fabrication_parameters['%d' % i]['%d' % j]['velocity'])
            else:
                
                branch.append(rg.Point3d(*fabrication_parameters['%d' % i]['%d' % j]['xyz']))
                Ed.append(fabrication_parameters['%d' % i]['%d' % j]['Ed'])
                velocity.append(fabrication_parameters['%d' % i]['%d' % j]['velocity'])
        
        path.append(branch)
        Ed_list.append(Ed)
        velocity_list.append(velocity)
        
    target_pts_out = th.list_to_tree(path)
    velocity_list_out = th.list_to_tree(velocity_list)
    Ed_list_out = th.list_to_tree(Ed_list)
    overall_setting_out = th.list_to_tree(overall_setting)
# ---------- end read ----------
color = Color(M=read.mesh)
mesh_3 = Mesh(read.close_mesh)
pt_6 = Point(read.target_pts_out)
volume = Volume(G=mesh_3)
volume_m3 = Panel(volume)

dom_2 = ConstructDomain(DomainStart="0.5", DomainEnd="1.0")

dom_3 = ConstructDomain(DomainStart="400", DomainEnd="500")

dom_4 = ConstructDomain(DomainStart="0.2", DomainEnd="0.8")

dom_5 = ConstructDomain(DomainStart="400", DomainEnd="500")

dom_6 = ConstructDomain(DomainStart="400", DomainEnd="500")

dom_7 = ConstructDomain(DomainStart="300", DomainEnd="500")

# ----
# Build Base Mesh
resolution = Slider(25, range=0..100)
offset = Slider(125, range=0..200)
build = GhPythonScript(mesh=mesh_2, offset=offset, resolution=resolution)  # -> out, mesh; inputs mesh: Mesh, resolution: Int32
# ---------- build: Python ----------
import Rhino.Geometry as rg
from robotic_plaster_spraying.utilities_fabrication.projection import RhinoMeshData

if mesh:
    points, fIDs, average_normal = RhinoMeshData(mesh)
    x_vec = rg.Vector3d.CrossProduct(average_normal, rg.Vector3d.ZAxis)
    x_vec.Unitize()
    
    b_box = rg.BoundingBox(points)
    box = rg.Box(b_box)
    
    x_length = box.X[1]-box.X[0]
    y_length = box.Y[1]-box.Y[0]
    height = box.Z[1]-box.Z[0]
    
    if x_length - y_length> 0:
        width = x_length
    else:
        width = y_length
    
    pt = box.Center - (width-offset)/2*x_vec - (height-offset)/2*rg.Vector3d.ZAxis
    plane = rg.Plane(pt, x_vec, rg.Vector3d.ZAxis)
    
    interval = rg.Interval(0,resolution+1)
    
    mesh = rg.Mesh.CreateFromPlane(plane, rg.Interval(0,width-offset), rg.Interval(0,height-offset), int(width/resolution), int(height/resolution))
# ---------- end build ----------
mesh_4 = Mesh(build.mesh)

# ----
# No Scan
number_slider_2 = Slider(6, range=0..10)
mesh_5 = Mesh(mesh)
build_2 = GhPythonScript(mesh=mesh_5, level=number_slider_2)  # -> out, mesh; inputs mesh: Mesh, level: Int32
# ---------- build_2: Python ----------
from robotic_plaster_spraying.utilities_fabrication.projection import RhinoToCompasMesh
from compas.datastructures import mesh_subdivide_quad
from compas_ghpython.artists import MeshArtist

c_mesh = RhinoToCompasMesh(mesh)
subd_mesh = mesh_subdivide_quad(c_mesh, k = level)

### Rhino mesh ###
mesh = MeshArtist(subd_mesh)
mesh = mesh.draw()
# ---------- end build_2 ----------
clean = CombineClean(Meshes=build_2.mesh)
area = Area(Geometry=clean)  # -> Area, Centroid
scale = Scale(Geometry=clean, Center=area.Centroid, Factor=Slider(1.1, range=0..10))  # -> Geometry, Transform

intcrv_2 = Interpolate(Vertices=pt_6, Degree=3, Periodic=False, KnotStyle=1)  # -> Curve, Length, Domain

list_8 = ValueList({"Constant Velocity": 0, "Linear Acceleration": 1, "Sinusoidal Acceleration": 2, "Custom Acceleration": 3, "Enhanced Velocity": 4, "Acceleration from Hand Gesture": 5, "From Json": 6}, selected="Linear Acceleration")
list_9 = ValueList({"Constant Ed": 0, "Linear Ed": 1, "Sinusoidal Ed": 2, "Custom Ed": 3, "Enhaced Ed": 4, "Ed from Hand Gesture": 5, "From Json": 6}, selected="Linear Ed")

list_10 = ValueList({"Constant Velocity": 0, "Linear Acceleration": 1, "Sinusoidal Acceleration": 2, "Custom Acceleration": 3, "Enhanced Velocity": 4, "Acceleration from Hand Gesture": 5, "From Json": 6}, selected="Constant Velocity")
list_11 = ValueList({"Constant Ed": 0, "Linear Ed": 1, "Sinusoidal Ed": 2, "Custom Ed": 3, "Enhaced Ed": 4, "Ed from Hand Gesture": 5, "From Json": 6}, selected="Constant Ed")

spray_path = Slider(0, range=0..10)
iteration = Slider(1, range=0..10)
send_to_scan = Button()
# Spray Layers
base_value_layer = Panel("20")
pattern_value = Panel("20")
number_of_iterations_for_each_spray_path = Panel("""60
60
60
60""")  # "Number of iterations for each spray path (for design visualization only)"

send_path = Button()
data = Data("0")

data_2 = Data(data)
# Custom Layer number
data_3 = Data(data_2)
# Branch
# Target Planes
data_4 = Data(spray_path)

crv_7 = Curve(flatten(crv_3))
crv_8 = Curve(crv_4)
pt_7 = Point(Point(0, 0, 0))
curve_direction = GhPythonScript(curves=crv_7, edited_curves=crv_8, robot_position=pt_7)  # -> out, curves, edited_curves, tangent, normal; inputs curves: list of Curve, edited_curves: list of Curve, robot_position: Point3d
# ---------- curve_direction: Python ----------
import Rhino.Geometry as rg

def check_curve_direction(curves, robot_position):
    r_curves = []
    for curve in curves:
        vec1 = rg.Vector3d(robot_position-curve.PointAtStart)
        vec2 = rg.Vector3d(robot_position-curve.PointAtEnd)
        cross_product = rg.Vector3d.CrossProduct(vec1,vec2)
        
        if cross_product.Z>0:
            curve.Reverse()
            r_curves.append(curve)
        else:
            r_curves.append(curve)
    return r_curves

curves = check_curve_direction(curves, robot_position)
edited_curves = check_curve_direction(edited_curves, robot_position)

vec = rg.Vector3d(curves[0].PointAtStart-curves[0].PointAtEnd)
normal=rg.Vector3d.CrossProduct(vec,rg.Vector3d(0,0,-1))
tangent=rg.Vector3d.CrossProduct(normal,rg.Vector3d(0,0,1))
# ---------- end curve_direction ----------
crv_9 = Curve(curve_direction.curves)
crv_10 = Curve(crv_9)

curve_direction_2 = GhPythonScript(curves=crv_6, edited_curves=crv_8, robot_position=pt_5)  # -> out, curves, edited_curves, tangent, normal; inputs curves: list of Curve, edited_curves: list of Curve, robot_position: Point3d; same code as curve_direction
crv_11 = Curve(simplify(graft(curve_direction_2.curves)))
bang = ExplodeTree(Data=crv_11)  # -> Branch0, Branch1, Branch2, Branch3, Branch4, Branch5
merge = Merge(Data1=bang.Branch2, Data2=bang.Branch3)
merge_2 = Merge(Data1=bang.Branch0, Data2=bang.Branch1)

dom_8 = ConstructDomain(DomainStart="0.5", DomainEnd="1.0")

# ----
# Read JSON_0
panel_5 = Panel("210122_2m_Panel_Base_Mesh_0.json")

dom_9 = ConstructDomain(DomainStart="0.5", DomainEnd="1.0")

dom_10 = ConstructDomain(DomainStart="0.1", DomainEnd="1.0")

# ----
# Velocity and Ed
velocity_constant = Slider(0.8, range=0.1..1.1)
ed_constant = Slider(500, range=0..500)

# ----
# Velocity and Ed
velocity_constant_2 = Slider(0.8, range=0.1..1.1)
ed_constant_2 = Slider(500, range=0..500)

value_list = ValueList({"No Scan": 0, "Layer 0": 1, "Read base mesh from json": 2}, selected="No Scan")
filter = StreamFilter(Gate=value_list, Stream0=scale.Geometry, Stream1=mesh_2, Stream2=mesh_2)
scanned_mesh = Mesh(filter)

# ----
# Project Base Mesh Vertices onto Scanned Mesh
mesh_6 = Mesh(scanned_mesh)

# ----
# Load Robot from urdf
py_3 = GhPythonScript()  # -> urdf_source
# ---------- py_3: Python ----------
import os
import sys

filepath = ghenv.Component.Attributes.Owner.OnPingDocument().FilePath
path = os.path.abspath(os.path.join(filepath, "..", ".."))
print(path)

urdf_source = os.path.abspath(os.path.join(path, "robot_description"))
# ---------- end py_3 ----------
panel_6 = Panel(py_3)
robot_name = ValueList({"ur10_2m"}, selected="ur10_2m")
disconnect = Button()
connect = Button()
# Robot Simulation
# ROS Connection
restart = Button()
list_12 = ValueList({"simulation": 0, "real_robot": 1}, selected="simulation")
path_2 = PythonScript(path=panel_6, robot_name=robot_name)  # -> urdf_source
# ---------- path_2: Python ----------
import os

urdf_source = os.path.join(os.path.abspath(path), robot_name)

assert(os.path.isdir(urdf_source))
# ---------- end path_2 ----------
ros = PythonScript(restart=restart, ip=list_12)  # -> ros_client
# ---------- ros: Python ----------
import time
import logging
import scriptcontext as sc

from compas_fab.backends import RosClient
from System import TimeSpan
from System.Threading import ManualResetEventSlim


LOGGER = logging.getLogger('roslibpy')

guid = str(ghenv.Component.InstanceGuid)
ros_client_key = "rosclient_" + guid

previous_client = sc.sticky.get(ros_client_key, None)
if previous_client:
    previous_client.terminate()

if ip == 0: #local
    ros_client = RosClient('127.0.0.1', 9090) #local, own laptop
elif ip == 1: #real robot
    ros_client = RosClient('127.0.0.1', 9090) #place holder

waitLock = ManualResetEventSlim(False)
ros_client.on_ready(lambda: waitLock.Set())

if not waitLock.Wait(TimeSpan.FromSeconds(5)):
    raise Exception('Unable to connect to ROS')

LOGGER.info('Connected to ROS')
# ---------- end ros ----------
connect_2 = PythonScript(ros_client=ros, connect=connect, disconnect=disconnect)  # -> out, ros_client
# ---------- connect_2: Python ----------
import logging
from System import TimeSpan
from System.Threading import ManualResetEventSlim

LOGGER = logging.getLogger('roslibpy')

if connect:
    if not ros_client.is_connected:
        LOGGER.debug('Connecting...')
        waitLock = ManualResetEventSlim(False)
        ros_client.on_ready(lambda: waitLock.Set())
        ros_client.connect()

        if not waitLock.Wait(TimeSpan.FromSeconds(5)):
            raise Exception('Unable to connect to ROS')
        LOGGER.debug('Reconnected')

if disconnect:
    if ros_client.is_connected:
        ros_client.terminate()
        LOGGER.debug('Terminated')
# ---------- end connect_2 ----------
units = ValueList({"m": 1, "mm": 1000}, selected="mm")
load = BooleanToggle(False)
robot = PythonScript(urdf_source=path_2, ros_client=connect_2.ros_client, scale_factor=units, load=load)  # -> out, robot
# ---------- robot: Python ----------
import os
from scriptcontext import sticky as st
import compas


from compas.robots import RobotModel
from compas.robots import LocalPackageMeshLoader
from compas_fab.ghpython import RobotArtist
from compas_fab.robots import RobotSemantics as RobotSemantics

from compas_fab.robots import Robot as Robot
from compas_fab.backends import RosClient

# Set high precision to import meshes defined in meters
compas.PRECISION = '12f'

# store data in component
guid = str(ghenv.Component.InstanceGuid)
robot_key = "robot_" + guid


if robot_key not in st:
    st[robot_key] = None


if ros_client and ros_client.is_connected and load == True:
    
    model = RobotModel.from_urdf_file(os.path.join(urdf_source, 'robot_description.urdf'))
    model.load_geometry(LocalPackageMeshLoader(urdf_source, 'robot_description'))
    semantics = RobotSemantics.from_srdf_file(os.path.join(urdf_source, 'robot_description.srdf'), model)
    artist = RobotArtist(model)
    robot = Robot(model, artist, semantics)
    
    robot.scale(scale_factor)
    st[robot_key] = robot

robot = st[robot_key]

if robot:
    robot.client = ros_client
# ---------- end robot ----------
info = PythonScript(robot=robot.robot)  # -> out, main_group_name
# ---------- info: Python ----------
if robot:
    robot.info()
    main_group_name = robot.main_group_name
# ---------- end info ----------
panel_7 = Panel(info.out)
main_planning_group = Text(info.main_group_name)
show = ValueList({"scan_pose": 0, "safe_pose": 1, "slider": 2}, selected="safe_pose")
state = ValueList({"forward_kinematics": 0, "plan_cartesian_motion": 1}, selected="plan_cartesian_motion")
show_end_effector_frame = BooleanToggle(True)
show_visual = BooleanToggle(True)
show_axes = BooleanToggle(False)

# ----
# Configuration
j1 = Slider(-10, range=-360..360)
j2 = Slider(-105, range=-360..360)
j3 = Slider(165, range=-360..360)
j4 = Slider(120, range=-360..360)
j5 = Slider(-80, range=-360..360)
j6 = Slider(0, range=-360..360)
forward_kinematics = PythonScript(robot=robot.robot, group=main_planning_group, show=show, j1=j1, j2=j2, j3=j3, j4=j4, j5=j5, j6=j6)  # -> configuration
# ---------- forward_kinematics: Python ----------
import math
from compas_fab.robots import Configuration

if robot:
    if show == 0:
        joint_positions = [-10 + math.degrees(3.14159), -105, 165, 120, -80, 0]
    if show == 1:
        joint_positions = [35 + math.degrees(3.14159), -35, 125, 90, -90, 0]
    if show == 2:
        joint_positions = [j1 + math.degrees(3.14159), j2, j3, j4, j5, j6]
    joint_positions = [math.radians(a) for a in joint_positions]
    types = robot.get_configurable_joint_types(group)
    configuration = Configuration(joint_positions, types)
    print configuration
# ---------- end forward_kinematics ----------

# ----
# Data Gathering
# Generate JSON
py_4 = GhPythonScript()  # -> json_source; same code as py_2
generate_fabrication_parameters_json = Button()
generate_mesh_json = Button()

panel_8 = Panel(py_4)

read_2 = GhPythonScript(path=panel_8, name_json=panel_5, generate_Mesh=Toggle(False))  # -> out, mesh; inputs generate_Mesh: Boolean
# ---------- read_2: Python ----------
import os
import json
from compas.datastructures import Mesh
from compas_ghpython.artists import MeshArtist


if generate_Mesh:
    filename = os.path.join(path, name_json)
    c_mesh = Mesh.from_json(filename)
    
    artist = MeshArtist(c_mesh)
    mesh = artist.draw()
# ---------- end read_2 ----------
dam = DataDam(DataA=read_2.mesh, BufferDelay=10000000, BufferMode=0)
clean_2 = CombineClean(Meshes=dam)

filter_2 = StreamFilter(Gate=value_list, Stream0=clean, Stream1=mesh_4, Stream2=clean_2)
base_mesh = Mesh(filter_2)

mesh_7 = Mesh(base_mesh)
projection = GhPythonScript(base_mesh=mesh_7, scanned_mesh=mesh_6, normal=curve_direction_2.normal)  # -> out, transformed_mesh, projected_direction; inputs base_mesh: Mesh, scanned_mesh: Mesh, normal: Vector3d
# ---------- projection: Python ----------
import Rhino.Geometry as rg
import Rhino as rc
import math as m
from robotic_plaster_spraying.utilities_fabrication import projection
reload(projection)
from robotic_plaster_spraying.utilities_fabrication.data_gathering import remapValues

def mapValueListAsColor(values):
    
    """ Make a list of HSL color where the values are mapped onto a 
    0.0 - 0.7 hue domain. Meaning that low values will be red, medium
    values green and large values blue """
    
    colors = []
    remappedValues = remapValues(values,0.0,0.7)
    for v in remappedValues:
        c = rc.Display.ColorHSL(v,1.0,0.5).ToArgbColor()
        #c = rc.Display.ColorXYZ(v,0,0)
        colors.append(c)
    
    return colors

def colorMesh(mesh,colors):
    """ Color mesh vertices by a list of colors """
    for i,c in enumerate(colors):
        mesh.VertexColors.SetColor(i,c)

points, fIDs, projected_direction = projection.RhinoMeshData(base_mesh)

angle = rg.Vector3d.VectorAngle(projected_direction,normal)
if angle>m.radians(100):
    print ("reverse")
    projected_direction.Reverse()

transformed_vertices = projection.PointProjectOnMesh(points, scanned_mesh, projected_direction)

transformed_mesh = rg.Mesh()

distances = []
for i in range(len(transformed_vertices)):
    transformed_mesh.Vertices.Add(transformed_vertices[i])
    distances.append(transformed_vertices[i].DistanceTo(points[i]))

[transformed_mesh.Faces.AddFace(*fID) for fID in fIDs]

colors = mapValueListAsColor(distances)
colorMesh(transformed_mesh,colors)
transformed_mesh.Smooth(1, True, True, True, True, 0)
# ---------- end projection ----------
mesh_8 = Mesh(projection.transformed_mesh)
vec = Vector(projection.projected_direction)

boundarymesh = Mesh(mesh_8)
medges = MeshEdges(Mesh=boundarymesh)  # -> NakedEdges, InteriorEdges, NonManifoldEdges
bondary = Bondary(C=medges.NakedEdges)  # -> rec_2, D
python_5 = GhPythonScript(surface=bondary.rec_2, direcX=list_4, direcY=list_5, direcZ=list_6)  # -> out, new_plane; same code as python_2
goal_plane = Plane(python_5.new_plane)
plnaxis = PlaneAxis(P=python_5.new_plane, B=35)
python_6 = GhPythonScript(
    filterpoints=dividebycount_2.P,
    goal_plane=goal_plane,
    ref_plane=ref_plane,
    scale_factorX=number_slider,
    scale_factorY=number_slider,
    scale_factorZ=number_slider)  # -> out, filterpoints, transformed_pointslist, transformed_curves, transformed_pointslist_planar, transformed_planeslist; inputs filterpoints: list of Point3d, filterpoints_planar: list of Point3d, filterplanes: list of Plane
# ---------- python_6: Python ----------
__author__ = "WeiTingChen"
ghenv.Component.Message = ""

import Rhino.Geometry as rg
import ghpythonlib.treehelpers as th
from copy import deepcopy


def orient_points_plane(points, ref_plane, goal_plane):
    # reference plane
    transformed_points = []
    
    #transform = rg.Transform.ChangeBasis(ref_plane.XAxis, ref_plane.YAxis, -ref_plane.ZAxis, goal_plane.XAxis,
    #goal_plane.YAxis, goal_plane.ZAxis)
    
    transform = rg.Transform.PlaneToPlane(ref_plane, goal_plane)
    move_points = deepcopy(points)
    for point in move_points:
        point.Transform(transform)
        transformed_points.append(point)
    return transformed_points

def transform_planes_plane(planes, ref_plane, goal_plane):
    # reference plane
    transformed_points = []
    transform = rg.Transform.PlaneToPlane(ref_plane, goal_plane)
    
    move_points = deepcopy(planes)
    for point in move_points:
        point.Transform(transform)
        transformed_points.append(point)
    return transformed_points


def scale(points, ref_plane, factorX, factorY, factorZ):
    # reference plane
    transformed_points = []
    transform = rg.Transform.Scale(ref_plane, factorX, factorY, factorZ)

    for point in points:
        scale_point = point
        scale_point.Transform(transform)
        transformed_points.append(scale_point)
    return transformed_points


##########################################
# RUN CODE #
transformed_planeslist = orient_points_plane(filterplanes, ref_plane, goal_plane)
#transformed_planeslist_scale = scale(transformed_planeslist, goal_plane, scale_factorX,  scale_factorY,  scale_factorZ)


transformed_pointslist = orient_points_plane(filterpoints, ref_plane, goal_plane)
transformed_pointslist = scale(transformed_pointslist, goal_plane, scale_factorX,  scale_factorY,  scale_factorZ)

#transformed_curves = rg.NurbsCurve.Create(False, 3, transformed_pointslist)


#transformed_pointslist_planar = orient_points_plane(filterpoints_planar, ref_plane, goal_plane)
# transformed_pointslist_planar = scale(transformed_pointslist_planar, goal_plane, scale_factor)
# ---------- end python_6 ----------
move_3 = Move(Geometry=python_6.transformed_pointslist, Motion=X)  # -> Geometry, Transform
intcrv_3 = Interpolate(Vertices=move_3.Geometry, Degree=3, Periodic=False, KnotStyle=1)  # -> Curve, Length, Domain

project_direction = Data(vec)
project = GhPythonScript(curves=crv_10, transformed_mesh=mesh_8, project_direction=project_direction, divide_length="25.0")  # -> out, target_points; inputs curves: list of Curve, transformed_mesh: Mesh
# ---------- project: Python ----------
from robotic_plaster_spraying.utilities_fabrication import projection
reload(projection)
import Rhino.Geometry as rg
import ghpythonlib.treehelpers as th

target_points = []
for curve in curves:
    p_IDs = curve.DivideByLength(divide_length,True)
    pts = [curve.PointAt(p_IDs[i]) for i in range(len(p_IDs))]
    p_pts = projection.PointProjectOnMesh(pts, transformed_mesh, project_direction, allow_to_skip = True)
    target_points.append(p_pts)

target_points = th.list_to_tree(target_points)
# ---------- end project ----------
pt_8 = Point(project.target_points)

bang_2 = ExplodeTree(Data=pt_8)  # -> Branch0, Branch1, Branch2, Branch3, Branch4, Branch5
pt_9 = Point([bang_2.Branch0, bang_2.Branch1])

pt_10 = Point(pt_9)

pt_11 = Point([bang_2.Branch2, bang_2.Branch3])
merge_3 = Merge(Data1=pt_9, Data2=pt_11)

pt_12 = Point(pt_9)

pt_13 = Point(pt_11)

mesh_9 = Mesh(mesh_8)
python_7 = GhPythonScript(
    area_points=python_4.area_points,
    curves=merge_2,
    divide_count=Slider(200, range=0..300),
    SprayingMesh=mesh_9,
    velocity_bound=dom_2,
    Ed_bound=dom_3)  # -> out, target_points, velocity_tree, Ed_tree, initial_points; inputs area_points: list, curves: list of Curve, divide_count: Int32, SprayingMesh: Mesh
# ---------- python_7: Python ----------
import Rhino.Geometry as rg
import ghpythonlib.treehelpers as th
import math
from robotic_plaster_spraying.utilities_fabrication.data_gathering import remapValues

from compas.geometry import Point, Line, Box, Vector, Polygon, Plane
from compas.geometry import is_intersection_line_triangle
from compas.geometry import intersection_line_triangle
from compas.geometry import bounding_box
from compas.geometry import intersection_line_plane
from compas.datastructures import Mesh
from compas.datastructures import meshes_join_and_weld
from compas_ghpython.artists import MeshArtist
from compas_rhino.geometry import RhinoMesh

def PointProjectOnMesh(pts, projected_mesh, vector, Compas_pt = False, allow_to_skip = False):

    if type(projected_mesh) is not type(rg.Mesh()):
        artist = MeshArtist(projected_mesh)
        projected_mesh = artist.draw()
#
#    if Compas_pt:
#        pts = [rg.Point3d(pt.x, pt.y, pt.z) for pt in pts]
#        vector = rg.Vector3d(vector.x, vector.y, vector.z)
    n_pts = []
    p_pts = []

    for i,pt in enumerate(pts):

        m_p1 = pt+vector*10000
        m_p2 = pt-vector*10000
        line = rg.Line(m_p1,m_p2)

        point,fID = rg.Intersect.Intersection.MeshLine(projected_mesh,line)

        if len(point) >= 1 and point!=None :
            point = point[0]
            n_pts.append(pt)
        elif len(point)==0:
            if allow_to_skip:
                continue
            else:
                point = line.ClosestPoint(p_pts[-1],True)

        if Compas_pt:
            p_pts.append(Point(point.X, point.Y, point.Z))
        else:
            p_pts.append(point)

    return n_pts,p_pts
    
    
    
corner_points=[]
#find the average point for srf corner_points
for list in area_points:
    x,y,z=0,0,0
    count=0
    for p in list:
        count += 1
        x += p.X
        y += p.Y
        z += p.Z
    corner_points.append(rg.Point3d(x/count,y/count,z/count))

#Create Original projection mesh and normal
projected_srf =rg.NurbsSurface.CreateFromPoints(corner_points,uCount=2,vCount=2,uDegree=1,vDegree=1)
p_mesh = rg.Mesh.CreateFromSurface(projected_srf)
normals = p_mesh.Normals
project_direction = rg.Vector3d(normals[0])
project_direction.Reverse()

#Move , scale and rotate the recorded inputs

#center of transformations
x,y,z = 0,0,0
for p in corner_points:
    x += p.X
    y += p.Y
    z += p.Z
t_center =rg.Point3d(x/4,y/4,z/4)

#target position

mesh_pt = SprayingMesh.Faces.GetFaceCenter(10)

scale = rg.Transform.Scale(rg.Plane(t_center,rg.Vector3d(0,0,0)),1,1,1)
rotation = rg.Transform.Rotation(project_direction,SprayingMesh.Normals[0],t_center)
flip = rg.Transform.Rotation(math.pi,t_center)

translate  =rg.Transform.Translation(mesh_pt.X-t_center.X,0,0)
p_mesh.Transform(rotation)
p_mesh.Transform(scale)
p_mesh.Transform(flip)
p_mesh.Transform(translate)

for crv in curves:
    
    crv.Transform(rotation)
    crv.Transform(scale)
    crv.Transform(flip)
    crv.Transform(translate)

#find the extrusion values(distances from the "scanned srf") and remap them within given bounds

v_min, v_max = velocity_bound
Ed_min, Ed_max = Ed_bound
velocity_values_list=[]
Ed_values_list=[]

p_IDs=[]
distances=[]
target_points =[]
initial_points = []


for curve in curves:
    p_IDs = curve.DivideByCount(divide_count,True)
    pts = [curve.PointAt(p_IDs[i]) for i in range(len(p_IDs))]
    pts,p_pts = PointProjectOnMesh(pts, SprayingMesh, rg.Vector3d.XAxis,Compas_pt = False, allow_to_skip = True)
    target_points.append(p_pts)
    initial_points.append(pts)
    dis = []
    for pt,ppt in zip(pts,p_pts):
        dis.append(pt.DistanceTo(ppt))
    velocity = remapValues(dis, v_max, v_min)
    Ed = remapValues(dis, Ed_max, Ed_min)
    velocity_values_list.append(velocity)
    Ed_values_list.append(Ed)
    
distances = th.list_to_tree(distances)
target_points = th.list_to_tree(target_points)
initial_points= th.list_to_tree(initial_points)

velocity_tree = th.list_to_tree(velocity_values_list)
Ed_tree = th.list_to_tree(Ed_values_list)
# ---------- end python_7 ----------
python_8 = GhPythonScript(
    area_points=python_4.area_points,
    curves=merge,
    divide_count=Slider(200, range=0..300),
    SprayingMesh=mesh_9,
    velocity_bound=dom_4,
    Ed_bound=dom_5)  # -> out, target_points, velocity_tree, Ed_tree, initial_points; inputs area_points: list, curves: list of Curve, divide_count: Int32, SprayingMesh: Mesh; same code as python_7

lng = ListLength(List=pt_12)
range = Range(Domain=Domain(0, 1), Steps=expr("x-1", lng))
graph = GraphMapper(
    range,
    x0=1,
    x1=0,
    y0=1,
    y1=0,
    A=1,
    B=0,
    container_name="Linear",
    Graph_x0=0.25,
    Graph_x1=0.75,
    Graph_y0=0.25,
    Graph_y1=0.75)
remap = RemapNumbers(Value=graph, Source=Domain(0, 1), Target=dom_6)  # -> Mapped, Clipped
remap_2 = RemapNumbers(Value=graph, Source=Domain(0, 1), Target=dom_9)  # -> Mapped, Clipped

lng_2 = ListLength(List=pt_12)
range_2 = Range(Domain=Domain(0, 1), Steps=expr("x-1", lng_2))
graph_2 = GraphMapper(range_2, x0=0, x1=1, y0=0, y1=1, container_name="Sine", Equation_px=[0, 0.5012611151], Equation_py=[1, 0])
remap_3 = RemapNumbers(Value=graph_2, Source=Domain(0, 1), Target=dom_9)  # -> Mapped, Clipped
remap_4 = RemapNumbers(Value=graph_2, Source=Domain(0, 1), Target=dom_6)  # -> Mapped, Clipped

lng_3 = ListLength(List=pt_13)
range_3 = Range(Domain=Domain(0, 1), Steps=expr("x-1", lng_3))
graph_3 = GraphMapper(
    range_3,
    x0=1,
    x1=0,
    y0=1,
    y1=0,
    A=1,
    B=0,
    container_name="Linear",
    Graph_x0=0.25,
    Graph_x1=0.75,
    Graph_y0=0.25,
    Graph_y1=0.75)
remap_5 = RemapNumbers(Value=graph_3, Source=Domain(0, 1), Target=dom_7)  # -> Mapped, Clipped
remap_6 = RemapNumbers(Value=graph_3, Source=Domain(0, 1), Target=dom_10)  # -> Mapped, Clipped

lng_4 = ListLength(List=pt_13)
range_4 = Range(Domain=Domain(0, 1), Steps=expr("x-1", lng_4))
graph_4 = GraphMapper(range_4, x0=0, x1=1, y0=0, y1=1, container_name="Sine", Equation_px=[0, 0.5012611151], Equation_py=[1, 0])
remap_7 = RemapNumbers(Value=graph_4, Source=Domain(0, 1), Target=dom_10)  # -> Mapped, Clipped
remap_8 = RemapNumbers(Value=graph_4, Source=Domain(0, 1), Target=dom_7)  # -> Mapped, Clipped

python_9 = GhPythonScript(curves=crv_9, target_points=pt_9, velocity_bound=dom_9, Ed_bound=dom_6)  # -> out, velocity_values_out, Ed_values_out, polyline_pt; inputs curves: list of Curve, target_points: tree of Point3d
# ---------- python_9: Python ----------
import ghpythonlib.treehelpers as th
import Rhino.Geometry as rg
from compas.geometry import Polyline
from compas.geometry import is_point_on_line
from robotic_plaster_spraying.utilities_fabrication.data_gathering import remapValues

target_points_list = [list(b) for b in target_points.Branches]

v_min, v_max = velocity_bound
Ed_min, Ed_max = Ed_bound

polylines = []

for i,curve in enumerate(curves):
    segment = list(curve.DuplicateSegments())
    pts = []
    for j,line in enumerate(segment):
        if j == len(segment)-1:
            pt_s = [line.PointAtStart.X, line.PointAtStart.Y, line.PointAtStart.Z] 
            pt_e = [line.PointAtEnd.X, line.PointAtEnd.Y, line.PointAtEnd.Z]
            pts.append(pt_s)
            pts.append(pt_e)
        else:
            pt_s = [line.PointAtStart.X, line.PointAtStart.Y, line.PointAtStart.Z] 
            pts.append(pt_s)
    
    polylines.append(Polyline(pts))

velocity_values_list = []
Ed_values_list = []
polyline_pt = []

for polyline, points in zip(polylines, target_points_list):

    count = len(points)
    t = 1/count
    velocity_values = []
    Ed_values = []

    # Find on which segment that the target points are located and asign segment's length (velocity)
    for j in range(count):
        t_pt = [points[j].X, points[j].Y, points[j].Z]
        
        pt = polyline.point(t*j)
        
        distance = t_pt[0] - pt[0]
        Ed_values.append(distance)
        polyline_pt.append(rg.Point3d(pt[0],pt[1],pt[2]))
        
        for line in polyline.lines:
            if is_point_on_line(pt, line) == True:
                length = line.length
                velocity_values.append(length)
                break

    velocity_values = remapValues(velocity_values, v_max, v_min)
    Ed_values = remapValues(Ed_values, Ed_min, Ed_max)

    velocity_values_list.append(velocity_values)
    Ed_values_list.append(Ed_values)


#print velocity_values_list
velocity_values_out = th.list_to_tree(velocity_values_list)
Ed_values_out = th.list_to_tree(Ed_values_list)
# ---------- end python_9 ----------
tag = TextTag(Location=pt_9, Text=python_9.velocity_values_out)

python_10 = GhPythonScript(curves=crv_9, edited_curves=curve_direction.edited_curves, target_points=pt_9, velocity_bound=dom_9, Ed_bound=dom_6)  # -> out, velocity_values_out, Ed_values_out; inputs curves: list of Curve, edited_curves: list of Curve, target_points: tree
# ---------- python_10: Python ----------
import Rhino.Geometry as rg
import ghpythonlib.treehelpers as th
from compas.geometry import Polyline
from compas.geometry import distance_point_point
from robotic_plaster_spraying.design import fabrication_parameter_effects
reload(fabrication_parameter_effects)

target_points_list = [list(b) for b in target_points.Branches]

v_min, v_max = velocity_bound
Ed_min, Ed_max = Ed_bound

polylines = []
e_polylines = []

for target_points, curve, edited_curve in zip(target_points_list, curves, edited_curves):
    
    count = len(target_points)-1
    p_IDs = curve.DivideByCount(count,True)
    e_p_IDs = edited_curve.DivideByCount(count,True)
    
    pts = []
    e_pts = []
    for p_ID, e_p_ID in zip(p_IDs, e_p_IDs):
        pt = curve.PointAt(p_ID)
        e_pt = edited_curve.PointAt(e_p_ID)
        pts.append(pt)
        e_pts.append(e_pt)
    
    polyline = Polyline(pts)
    e_polyline = Polyline(e_pts)
    
    polylines.append(polyline)
    e_polylines.append(e_polyline)

velocity_values_list, Ed_values_list = fabrication_parameter_effects.Custom_Acceleration_and_Ed(polylines, e_polylines, v_min, v_max, Ed_min, Ed_max)

#print velocity_values_list
velocity_values_out = th.list_to_tree(velocity_values_list)
Ed_values_out = th.list_to_tree(Ed_values_list)
# ---------- end python_10 ----------
python_11 = GhPythonScript(target_points=pt_9, velocity_bound=dom_9, Ed_bound=dom_6)  # -> out, velocity_tree, Ed_tree; inputs target_points: tree of Point3d
# ---------- python_11: Python ----------
import ghpythonlib.treehelpers as th
from compas.geometry import Point
from robotic_plaster_spraying.design import UserInputforEnhancingEffect

if target_points.BranchCount > 1:
    
    v_min, v_max = velocity_bound
    Ed_min, Ed_max = Ed_bound
    
    target_points = [list(b) for b in target_points.Branches]
    
    c_pts_list = []
    for points in target_points:
        c_pts = []
        for pt in points:
            c_pts.append(Point(pt.X, pt.Y, pt.Z))
        c_pts_list.append(c_pts)
    
    velocity_list, Ed_list = UserInputforEnhancingEffect(c_pts_list, v_max, v_min, Ed_max, Ed_min)
    
    velocity_tree = th.list_to_tree(velocity_list)
    Ed_tree = th.list_to_tree(Ed_list)
# ---------- end python_11 ----------

python_12 = GhPythonScript(curves=crv_9, target_points=pt_11, velocity_bound=dom_10, Ed_bound=dom_7)  # -> out, velocity_values_out, Ed_values_out, polyline_pt; inputs curves: list of Curve, target_points: tree of Point3d; same code as python_9
tag_2 = TextTag(Location=pt_11, Text=python_12.velocity_values_out)

python_13 = GhPythonScript(curves=crv_9, edited_curves=curve_direction.edited_curves, target_points=pt_11, velocity_bound=dom_10, Ed_bound=dom_7)  # -> out, velocity_values_out, Ed_values_out; inputs curves: list of Curve, edited_curves: list of Curve, target_points: tree; same code as python_10
python_14 = GhPythonScript(target_points=pt_11, velocity_bound=dom_10, Ed_bound=dom_7)  # -> out, velocity_tree, Ed_tree; inputs target_points: tree of Point3d; same code as python_11
intcrv_4 = Interpolate(Vertices=python_7.target_points, Degree=3, Periodic=False, KnotStyle=1)  # -> Curve, Length, Domain
intcrv_5 = Interpolate(Vertices=python_8.target_points, Degree=3, Periodic=False, KnotStyle=1)  # -> Curve, Length, Domain
distance_filter_vel = Data(python_7.velocity_tree)
distance_filter_ed = Data(python_7.Ed_tree)
distance_filter_vel_2 = Data(python_8.velocity_tree)
initialcurves = Curve(intcrv_4.Curve)
distance_filter_ed_2 = Data(python_8.Ed_tree)
target_points = Point(python_7.target_points)
initialcurves_2 = Curve(intcrv_5.Curve)
target_points_2 = Point(python_8.target_points)

expression = Expression(x=pt_12, y=ed_constant, Expression="y")
expression_2 = Expression(x=pt_12, y=velocity_constant, Expression="y")

expression_3 = Expression(x=pt_13, y=ed_constant_2, Expression="y")
expression_4 = Expression(x=pt_13, y=velocity_constant_2, Expression="y")

merge_4 = Merge(Data1=simplify(target_points), Data2=simplify(target_points_2))
merge_5 = Merge(Data1=simplify(distance_filter_vel), Data2=simplify(distance_filter_vel_2))
merge_6 = Merge(Data1=simplify(distance_filter_ed), Data2=simplify(distance_filter_ed_2))
velocity = Data(merge_5)
target_points_3 = Point(merge_4)
ed = Data(merge_6)
filter_3 = StreamFilter(
    Gate=list_10,
    Stream0=expression_2,
    Stream1=remap_2.Mapped,
    Stream2=remap_3.Mapped,
    Stream3=python_10.velocity_values_out,
    Stream4=python_11.velocity_tree,
    Stream5=python_9.velocity_values_out,
    Stream6=read.velocity_list_out)
filter_4 = StreamFilter(
    Gate=list_11,
    Stream0=expression,
    Stream1=remap.Mapped,
    Stream2=remap_4.Mapped,
    Stream3=python_10.Ed_values_out,
    Stream4=python_11.Ed_tree,
    Stream5=python_9.Ed_values_out,
    Stream6=read.Ed_list_out)
filter_5 = StreamFilter(
    Gate=list_8,
    Stream0=expression_4,
    Stream1=remap_6.Mapped,
    Stream2=remap_7.Mapped,
    Stream3=python_13.velocity_values_out,
    Stream4=python_14.velocity_tree,
    Stream5=python_12.velocity_values_out,
    Stream6=read.velocity_list_out)
filter_6 = StreamFilter(
    Gate=list_9,
    Stream0=expression_3,
    Stream1=remap_5.Mapped,
    Stream2=remap_8.Mapped,
    Stream3=python_13.Ed_values_out,
    Stream4=python_14.Ed_tree,
    Stream5=python_12.Ed_values_out,
    Stream6=read.Ed_list_out)
merge_7 = Merge(Data1=simplify(filter_3), Data2=simplify(filter_5))
merge_8 = Merge(Data1=simplify(filter_4), Data2=simplify(filter_6))
velocity_2 = Data(merge_7)
ed_2 = Data(merge_8)

python_15 = GhPythonScript(target_points=target_points_3, project_direction=project_direction, Ed=ed, angle=Slider(0, range=-15..0))  # -> out, target_frames; inputs target_points: tree of Point3d, Ed: tree
# ---------- python_15: Python ----------
import math
import Rhino.Geometry as rg
import ghpythonlib.treehelpers as th
from compas.geometry import Point, Vector, Polyline, Frame
from compas.geometry import cross_vectors
from compas.geometry import Rotation
from compas_ghpython import draw_frame
from compas.geometry import Translation, Vector


project_direction = Vector(project_direction.X, project_direction.Y, project_direction.Z)
project_direction.unitize()
n_z_vec = Vector(0,0,-1)
p_z_vec = Vector(0,0,1)
angle = math.radians(angle)

target_points_list = [list(b) for b in target_points.Branches]
Ed_list = [list(b) for b in Ed.Branches]

c_target_points = []
for target_points in target_points_list:
    if len(target_points) == 1:
        c_target_points.append(Point(target_points.X, target_points.Y, target_points.Z))
    else:
        temp_points = []
        for pt in target_points:
            temp_points.append(Point(pt.X, pt.Y, pt.Z))
        c_target_points.append(temp_points)

# Normal Averaged From Base Mesh
target_frames = []

for pts, Eds in zip(c_target_points, Ed_list):
    temp_list = []
    for pt, Ed in zip(pts, Eds):
        # Ed
        pt = pt + project_direction * Ed
        
        xAxis = cross_vectors(project_direction,n_z_vec)
        frame = Frame(pt, xAxis, n_z_vec)
        
        #Rotation
        Rx = Rotation.from_axis_and_angle(frame.xaxis, angle, frame.point)
        frame.transform(Rx)
        
        temp_list.append(frame)
    target_frames.append(temp_list)
# ---------- end python_15 ----------
python_16 = GhPythonScript(target_frames=python_15.target_frames)  # -> out, target_planes; inputs target_frames: list
# ---------- python_16: Python ----------
import Rhino.Geometry as rg
import ghpythonlib.treehelpers as th

target_planes = []
for frames in target_frames:
    temp_list = []
    for frame in frames:
        plane = rg.Plane(rg.Point3d(frame.point.x, frame.point.y, frame.point.z), 
                         rg.Vector3d(frame.xaxis.x, frame.xaxis.y, frame.xaxis.z),
                         rg.Vector3d(frame.yaxis.x, frame.yaxis.y, frame.yaxis.z))
        temp_list.append(plane)
    target_planes.append(temp_list)

target_planes = th.list_to_tree(target_planes)
# ---------- end python_16 ----------
pln = Plane(python_16.target_planes)

intcrv_6 = Interpolate(Vertices=pln, Degree=3, Periodic=False, KnotStyle=1)  # -> Curve, Length, Domain
iterations_for_each_spray_path = GhPythonScript(
    base_curves=flatten(intcrv_6.Curve),
    base_value=base_value_layer,
    pattern_value=pattern_value,
    base_vel_filter=simplify(velocity),
    base_ed_filter=simplify(ed))  # -> out, velocities, eds, flatten(iterations); inputs base_curves: list of Curve, pattern_curves: list of Curve, base_value: Int32, pattern_value: Int32, base_vel_filter: tree, base_ed_filter: tree, pat_vel_filter: tree, pat_ed_filter: tree, trigger_values: list
# ---------- iterations_for_each_spray_path: Python ----------
import ghpythonlib.treehelpers as th
import Rhino.Geometry as rg
import rhinoscriptsyntax as rc
#from robotic_plaster_spraying.utilities_fabrication.data_gathering import remapValues

iterations=[]
velocities=[]
eds=[]
c_velocities=[]
c_eds=[]
base_vel_filter = [list(b) for b in base_vel_filter.Branches]
base_ed_filter = [list(b) for b in base_ed_filter.Branches]
pat_vel_filter = [list(b) for b in pat_vel_filter.Branches]
pat_ed_filter = [list(b) for b in pat_ed_filter.Branches]



for k in range(len(base_curves)):
    iterations.append(base_value)
for pp in pattern_curves:
    iterations.append(pattern_value)


a=0
for i in range(len(base_curves)+len(pattern_curves)):
    if i<(len(base_curves)):
        vel=[]
        ed=[]
        for bv,be in zip(base_vel_filter[i],base_ed_filter[i]):
            vel.append(bv)
            ed.append(be)
        c_velocities.append(vel)
        c_eds.append(ed)
        
    else:
        
        vel=[]
        ed=[]
        for pv,pe in zip(pat_vel_filter[i],pat_ed_filter[i]):
            vel.append(pv)
            ed.append(pe)
            print ed
            
        c_velocities.append(vel)
        c_eds.append(ed)

eds = c_eds
velocities = c_velocities
velocities = th.list_to_tree(velocities)
eds = th.list_to_tree(eds)
# ---------- end iterations_for_each_spray_path ----------
data_5 = Data(iterations_for_each_spray_path.iterations)
pln_2 = Plane(pln)
mesh_10 = Mesh(mesh_8)
vec_2 = Vector(vec)
data_6 = Data(velocity)
data_7 = Data(ed)
mesh_11 = Mesh(base_mesh)
# Base Mesh
data_8 = Data(data_5)
# Transformed Mesh
mesh_12 = Mesh(mesh_11)
# Projection Direction
mesh_13 = Mesh(mesh_10)
vec_3 = Vector(vec_2)
pln_3 = Plane(simplify(pln_2))
# Velocity
pt_14 = Point(simplify(pln_2))
# Ed
data_9 = Data(data_6)
# Layer number
data_10 = Data(data_7)

# ----
# Robot Control
python_17 = GhPythonScript(target_planes=pln_3, velocity=data_9, branch=data_4)  # -> out, simplify(target_planes_out), simplify(velocity_out); inputs target_planes: tree, velocity: tree, branch: Int32
# ---------- python_17: Python ----------
print target_planes.BranchCount
if target_planes.BranchCount > 1:
    target_planes_list = [list(b) for b in target_planes.Branches]
    velocity_list = [list(b) for b in velocity.Branches]
    
    target_planes_out = target_planes_list[branch]
    velocity_out = velocity_list[branch]
else:
    target_planes_out = target_planes
    velocity_out = velocity
# ---------- end python_17 ----------
reverse = BooleanToggle(True)
run_2 = BooleanToggle(False)
robotic_fabrication = GhPythonScript(
    run=run_2,
    target_planes=python_17.target_planes_out,
    velocity=python_17.velocity_out,
    iteration=iteration,
    reverse_list=reverse,
    send=send_path,
    send_to_scan=send_to_scan)  # -> f_planes; inputs target_planes: tree of Plane, velocity: tree, iteration: Int32, reverse_list: Boolean, send_to_scan: Boolean
# ---------- robotic_fabrication: Python ----------
################################################################################
############# IMPORTS ##########################################################
################################################################################
###     Future imports          ###
from __future__ import division, absolute_import, print_function
###     Standard lib imports    ###
import math as m
###     Rhino lib imports       ###
import Rhino.Geometry as rg
import scriptcontext as sc
import ghpythonlib.treehelpers as t
###     UR Robot Library        ###
import comm
import ur_standard 
reload(comm)
reload(ur_standard)
################################################################################
############# FUNCTIONS ########################################################
################################################################################
if run:
    def popup(text):
        cmd = "\tpopup(\"{}\")\n".format(text)
        return cmd
    ################################################################################
    #############      #############################################################
    ############# MAIN #############################################################
    #############      #############################################################
    ################################################################################
    ### Create "global" variables   ###
    debug = []
    viz_planes = []
    ### Create a script object      ###
    script  = ""
    s_script  = ""
    f_script = ""
    ### Robot inital values         ###
    robot_speed = 0.2  # m/s
    robot_accel = 0.2   # m/s2
    blend_rad = 0.02   # m
    ACTUATOR_IO = 1
    scan_time = 20     #s
    spray_sleep = 0.45    #s
    translation_vector = sc.sticky["translation_vector_key"]
    ### Tool related variables      ###
    #TOOL_HEIGHT = 0   #mm
    ### Process related variables   ###
    ACTUATOR_IO = 1
    squeeze_valve_IO = 0
    air_pressure_IO = 1
    forward_pumping_IO = 6
    backward_pumping_IO = 7
    pump_speed = 0.3
    ################################################################################
    ### Define the TCP              ###

    print(translation_vector)
    set_tcp = ur_standard.set_tcp_by_angles(translation_vector[0], 0, translation_vector[2], 
                                            0.0, 0.0, 0.0)
    script += set_tcp
    
    script += ur_standard.set_digital_out(squeeze_valve_IO, True)
    script += ur_standard.set_digital_out(air_pressure_IO, False)
    script += ur_standard.set_digital_out(forward_pumping_IO, False)
    script += ur_standard.set_analog_out(1, pump_speed)
    
    pos = [ m.radians(35), 
            m.radians(-35), 
            m.radians(125), 
            m.radians(90), 
            m.radians(-90),
            m.radians(0)]
    script += ur_standard.move_j(pos, 0.1, 0.5)
    
    s_pos = [ m.radians(-10),
        m.radians(-105),
        m.radians(165),
        m.radians(120),
        m.radians(-80),
        m.radians(0)]
        
    ### Sent to scan ###
    
    s_script += ur_standard.move_j(pos, 0.1, 0.5)
    s_script += ur_standard.move_j(s_pos, 0.1, 0.5)
    
    ### Sort plane ###
    
    target_planes_list = [list(b) for b in target_planes.Branches]
    velocity_list = [list(b) for b in velocity.Branches]
    
    f_planes = []
    f_speeds = []
    start_IDs = []
    stop_IDs = []
    stop_air_pump_IDs = []
    
    for i in range(iteration):
        for target_planes_b, velocity_b in zip(target_planes_list, velocity_list):
            if reverse_list:
                if i > 0:
                    #print(i,"reverse")
                    target_planes_b.reverse()
                    velocity_b.reverse()
            
            for j in range(len(target_planes_b)):
                if j == 0:
                    f_planes.extend([target_planes_b[j],target_planes_b[j]])
                    f_speeds.extend([velocity_b[j],velocity_b[j]])
                    start_IDs.append(len(f_planes)-1)
                elif j == len(target_planes_b)-1:
                    f_planes.extend([target_planes_b[j],target_planes_b[j]])
                    f_speeds.extend([velocity_b[j],velocity_b[j]])
                    stop_IDs.append(len(f_planes)-1)
                else:
                    f_planes.append(target_planes_b[j])
                    f_speeds.append(velocity_b[j])
    
    ### Start Robotic Spraying Fabrication process ###
    
    for i in range(len(f_planes)):
        
        speed = f_speeds[i]
        # Robot_accel = speed/2
        script += ur_standard.move_l(f_planes[i], speed/2, speed ,blend_radius = blend_rad)
        # Control IO
        if i in start_IDs:
            script += ur_standard.set_digital_out(squeeze_valve_IO, False)
            script += ur_standard.set_digital_out(forward_pumping_IO, True)
            script += ur_standard.set_digital_out(air_pressure_IO, True)
        elif i in stop_air_pump_IDs:
            script += ur_standard.set_digital_out(forward_pumping_IO, False)
            script += ur_standard.set_digital_out(air_pressure_IO, False)
        elif i in stop_IDs[:-1]:
            if not reverse_list:
                #print("False")
                script += ur_standard.set_digital_out(forward_pumping_IO, False)
                script += ur_standard.set_digital_out(squeeze_valve_IO, True)
                script += ur_standard.sleep(spray_sleep)
                script += ur_standard.set_digital_out(air_pressure_IO, False)
        elif i == stop_IDs[-1]:
            script += ur_standard.set_digital_out(forward_pumping_IO, False)
            script += ur_standard.set_digital_out(squeeze_valve_IO, True)
            script += ur_standard.sleep(spray_sleep)
            script += ur_standard.set_digital_out(air_pressure_IO, False)
            script += ur_standard.move_j(pos, 0.1, 0.5)
            script += ur_standard.move_j(s_pos, 0.1, 0.5)
            script += ur_standard.sleep(scan_time)
    
    script += ur_standard.set_analog_out(1, 0.0)
    script += ur_standard.move_j(pos, 0.1, 0.5)
    
    ################################################################################
    ### Concatenate script ###
    script = comm.concatenate_script(script) 
    s_script = comm.concatenate_script(s_script)
    ### Send to the robot ###
    if send:
        comm.send_script(script, 1)
    if send_to_scan:
        comm.send_script(s_script, 1)
# ---------- end robotic_fabrication ----------
pln_4 = Plane(robotic_fabrication)

# ----
# Design Visualization
# Linear Model
toggle = BooleanToggle(True)
dam_2 = DataDam(DataF=mesh_12, DataA=pt_14, DataB=data_9, DataC=data_10, DataD=data_8, DataE=vec_3, BufferDelay=10000000, BufferMode=0)  # -> DataF, DataA, DataB, DataC, DataD, DataE
toggle_2 = BooleanToggle(True)
mesh_14 = Mesh(dam_2.DataF)
pt_15 = Point(dam_2.DataA)
vel = Data(dam_2.DataB)
linear_model = GhPythonScript(
    base_mesh=mesh_14,
    target_points=pt_15,
    velocity=vel,
    Ed=dam_2.DataC,
    layer_number=dam_2.DataD,
    project_direction=dam_2.DataE,
    run=toggle,
    color=toggle_2)  # -> out, simulate_Mesh, thickness; inputs base_mesh: Mesh, target_points: tree of Point3d, velocity: tree, Ed: tree, layer_number: list of Int32, project_direction: Vector3d, run: Boolean, color: Boolean
# ---------- linear_model: Python ----------
import Rhino as rc
from robotic_plaster_spraying.utilities_fabrication import linear_model

reload(linear_model)

from compas_ghpython.artists import MeshArtist

def remapValues(values, targetMin, targetMax):
    
    """ Remap numbers into a numeric domain """
    
    if len(set(values)) >1:
        
        remappedValues = []
        
        # Get source domain min and max
        scrMin = min(values)
        scrMax = max(values)
        
        # Iterate through the values and remap them
        for v in values:
            rv = ((v-scrMin)/(scrMax-scrMin))*(targetMax-targetMin)+targetMin
            remappedValues.append(rv)
        
        return remappedValues
    
    # Else return targetMax for each value
    else:
        return [targetMax]*len(values)


def mapValueListAsColor(values):
    """ Make a list of HSL color where the values are mapped onto a 
    0.0 - 0.7 hue domain. Low values will be red, medium
    values will be green and large values will be blue """
    
    colors = []
    remappedValues = remapValues(values,0.0,0.7)
    for v in remappedValues:
        c = rc.Display.ColorHSL(v,1.0,0.5).ToArgbColor()
        colors.append(c)
    return colors


def colorMesh(mesh,colors):
    """ Color mesh vertices by list of colors """
    for i,c in enumerate(colors):
        mesh.VertexColors.SetColor(i,c)

if run:
    simulate_Mesh, thickness = linear_model.visualize(base_mesh, target_points, velocity, Ed, layer_number, project_direction, plastering=True, grinding=False, m_scale=False, mm_scale=True)
    artist = MeshArtist(simulate_Mesh)
    simulate_Mesh = artist.draw()
    
    if color:
        thickness_to_color = mapValueListAsColor(thickness)
        colorMesh(simulate_Mesh,thickness_to_color)
# ---------- end linear_model ----------
mesh_15 = Mesh(linear_model.simulate_Mesh)
toggle_3 = BooleanToggle(False)
python_18 = GhPythonScript(data=simplify(graft(linear_model.thickness)), run=toggle_3, reset=Button())  # -> out, data; inputs data: tree
# ---------- python_18: Python ----------
from Grasshopper import DataTree

if reset or 'rec' not in globals(): rec = DataTree[object]()
if run and not reset: rec.MergeTree(data)

data = rec
# ---------- end python_18 ----------
python_19 = GhPythonScript(base_mesh=mesh_14, thickness=python_18.data, project_direction=dam_2.DataE, run=toggle_3, color=toggle_2)  # -> out, simulate_Mesh; inputs base_mesh: Mesh, thickness: tree, project_direction: Vector3d, run: Boolean, color: Boolean
# ---------- python_19: Python ----------
import Rhino.Geometry as rg
import Rhino as rc

def remapValues(values, targetMin, targetMax):
    
    """ Remap numbers into a numeric domain """
    
    if len(set(values)) >1:
        
        remappedValues = []
        
        # Get source domain min and max
        scrMin = min(values)
        scrMax = max(values)
        
        # Iterate through the values and remap them
        for v in values:
            rv = ((v-scrMin)/(scrMax-scrMin))*(targetMax-targetMin)+targetMin
            remappedValues.append(rv)
        
        return remappedValues
    
    # Else return targetMax for each value
    else:
        return [targetMax]*len(values)


def mapValueListAsColor(values):
    """ Make a list of HSL color where the values are mapped onto a 
    0.0 - 0.7 hue domain. Low values will be red, medium
    values will be green and large values will be blue """
    
    colors = []
    remappedValues = remapValues(values,0.0,0.7)
    for v in remappedValues:
        c = rc.Display.ColorHSL(v,1.0,0.5).ToArgbColor()
        colors.append(c)
    return colors


def colorMesh(mesh,colors):
    """ Color mesh vertices by list of colors """
    for i,c in enumerate(colors):
        mesh.VertexColors.SetColor(i,c)

if run:
    thickness_list = [list(b) for b in thickness.Branches]
    
    thickness = []
    
    for t in thickness_list:
        thickness.append(sum(t))
    
    for i in range(base_mesh.Vertices.Count):
        pt = base_mesh.Vertices.Item[i]
        x = rg.Transform.Translation(project_direction*thickness[i])
        pt.Transform(x)
        base_mesh.Vertices.SetVertex(i, pt)
    
    simulate_Mesh = base_mesh
    
    if color:
        thickness_to_color = mapValueListAsColor(thickness)
        colorMesh(simulate_Mesh,thickness_to_color)
# ---------- end python_19 ----------
mesh_16 = Mesh(python_19.simulate_Mesh)

pln_5 = Plane(pln_3)
mesh_17 = Mesh(mesh_13)
velocity_3 = Data(data_9)
ed_3 = Data(data_10)
generate_json = GhPythonScript(
    transformed_mesh=mesh_17,
    target_points=pln_5,
    velocity=velocity_3,
    Ed=ed_3,
    custom_layer_num=data_8,
    iteration=iteration,
    branch=data_4,
    json_name=data_3,
    file_path=panel_8,
    name_json="210122_2m_Panel",
    generate_mesh_JSON=generate_mesh_json,
    generate_fabrication_parameters_JSON=generate_fabrication_parameters_json)  # -> out, mesh; inputs transformed_mesh: Mesh, target_points: tree of Plane, velocity: tree, Ed: tree, custom_layer_num: list of Int32, iteration: Int32, branch: Int32, json_name: Int32, generate_mesh_JSON: Boolean, generate_fabrication_parameters_JSON: Boolean
# ---------- generate_json: Python ----------
import os
import json
import Rhino.Geometry as rg
from compas.datastructures import Mesh
from compas_ghpython.artists import MeshArtist
from compas_rhino.geometry import RhinoMesh
from robotic_plaster_spraying.utilities_fabrication.projection import RhinoToCompasMesh
from robotic_plaster_spraying.utilities_fabrication.data_gathering import WriteDictToJson

pump_speed = 0.3 
air_pressure = 3 #bar

plane_list = [list(b) for b in target_points.Branches]
velocity_list = [list(b) for b in velocity.Branches]
Ed_list = [list(b) for b in Ed.Branches]

fabrication_parameters = {}
for i in range(len(plane_list)):
    fabrication_parameters[i] = {} 
    for j in range(len(plane_list[i])):
        plane = plane_list[i][j]
        if i == 0 and j == 0:
            print i,j
            fabrication_parameters[i][j] = {'xyz': [plane.OriginX, plane.OriginY,plane.OriginZ],
                                            'normal': [plane.Normal.X, plane.Normal.Y, plane.Normal.Z],
                                            'velocity': velocity_list[i][j],
                                            'Ed': Ed_list[i][j],
                                            'pump_speed': pump_speed,
                                            'air_pressure': air_pressure,
                                            'custom_layer_num': custom_layer_num
                                           }
        else:
            fabrication_parameters[i][j] = {'xyz': [plane.OriginX, plane.OriginY,plane.OriginZ],
                                            'normal': [plane.Normal.X, plane.Normal.Y, plane.Normal.Z],
                                            'velocity': velocity_list[i][j],
                                            'Ed': Ed_list[i][j]
                                           }

if json_name == 0:
    branch = 'base_mesh'

c_mesh = RhinoToCompasMesh(transformed_mesh)
c_mesh.vertex_attributes(0, ['iteration', 'branch'], [iteration, branch])

### Generate JSON ###
mesh_filename = os.path.join(file_path, name_json+'_Base_Mesh_%d.json' % json_name)
parameters_filename = os.path.join(file_path, name_json+'_Fabrication_Parameters.json')


if generate_mesh_JSON:
    c_mesh.to_json(mesh_filename, pretty = True)

if generate_fabrication_parameters_JSON:
    WriteDictToJson(parameters_filename, fabrication_parameters)

### Rhino mesh ###
mesh = MeshArtist(c_mesh)
mesh = mesh.draw()
# ---------- end generate_json ----------
mesh_18 = Mesh(generate_json.mesh)

# ----
# Volume
toggle_4 = BooleanToggle(False)
volume_2 = GhPythonScript(mesh=mesh_16, run=toggle_4, reverse_bool=Toggle(True))  # -> out, close_mesh; inputs mesh: Mesh, run: Boolean, reverse_bool: Boolean
# ---------- volume_2: Python ----------
from robotic_plaster_spraying.utilities_fabrication import projection
reload(projection)
from compas_ghpython.artists import MeshArtist

if run:
    mesh = projection.RhinoToCompasMesh(mesh)
    close_mesh = projection.CapMesh(mesh, reverse = reverse_bool)
    
    ### Rhino mesh ###
    mesh = MeshArtist(close_mesh)
    close_mesh = mesh.draw()
# ---------- end volume_2 ----------
mesh_19 = Mesh(volume_2.close_mesh)
volume_3 = Volume(G=mesh_19)
volume_m3_2 = Panel(volume_3)

# ---- group: cartesian motion
# Plan Cartesian Motion
py_5 = PythonScript(robot=robot.robot)  # -> configuration
# ---------- py_5: Python ----------
from compas_fab.robots import Configuration

if robot:
    types = robot.get_configurable_joint_types()
    values = [0] * len(types)

    configuration = Configuration(values, types)
    print configuration
# ---------- end py_5 ----------
list_13 = ValueList({"0", "1"}, selected="0")
start_configuration = Data(forward_kinematics)
compute = BooleanToggle(True)
filter_7 = StreamFilter(Gate=list_13, Stream0=start_configuration, Stream1=py_5)
planes = Plane(python_17.target_planes_out)
plan_cartesian_motion = PythonScript(
    robot=robot.robot,
    group=main_planning_group,
    start_configuration=filter_7,
    planes=planes,
    iteration=iteration,
    reverse_list=reverse,
    max_step=10,
    compute=compute)  # -> out, robot, group, trajectory; inputs planes: list, iteration: Int32, reverse_list: Boolean
# ---------- plan_cartesian_motion: Python ----------
import logging
import scriptcontext as sc
from compas.geometry import Frame
from compas.geometry import Translation
import math
from compas_fab.robots import Configuration

guid = str(ghenv.Component.InstanceGuid)
response_key = "response_" + guid
translation_vector_key = "translation_vector" + guid
if response_key not in sc.sticky:
    sc.sticky[response_key] = None

if robot:
    if robot.client:
        if robot.client.is_connected:
            if start_configuration and compute:
                frames = []
                for i in range(iteration):
                    if reverse_list and i > 0:
                        planes.reverse()
                    for plane in planes:
                        frames.append(Frame(plane.Origin, plane.ZAxis, -plane.XAxis))
                    
                    joint_positions = [math.radians(a) for a in [0, 0, 0, 0, 0, 0]]
                    types = robot.get_configurable_joint_types(group)
                    configuration = Configuration(joint_positions, types)
                    frames_temp = robot.transformed_frames(configuration, group)
                    f1 = frames_temp[8]
                    f2 = frames_temp[9]
                    translation_vector = [f1[0][1] - f2[0][1], 0, f1[0][2] - f2[0][2]]
                    sc.sticky["translation_vector_key"] = translation_vector
                    x = Translation.from_vector(translation_vector)
                    for frame in frames:
                        frame.transform(x)
                
                options = {'max_step':float(max_step)}
                response = robot.plan_cartesian_motion(frames, start_configuration=start_configuration, group=group, options=options)
                sc.sticky[response_key] = response
        else:
            print("Robot is not connected")
            sc.sticky[response_key] = None

trajectory = sc.sticky[response_key]
# ---------- end plan_cartesian_motion ----------
vis = PythonScript(trajectory=plan_cartesian_motion.trajectory)  # -> P, V, A, time
# ---------- vis: Python ----------
from compas_ghpython import list_to_ghtree

if trajectory:

    positions = []
    velocities = []
    accelerations = []
    time_from_start = []

    for p in trajectory.points:
        positions.append(p.positions)
        velocities.append(p.velocities)
        accelerations.append(p.accelerations)
        time_from_start.append(p.time_from_start.seconds)

    P = list_to_ghtree(list(zip(*positions)))
    V = list_to_ghtree(list(zip(*velocities)))
    A = list_to_ghtree(list(zip(*accelerations)))
    time = time_from_start[-1]
# ---------- end vis ----------
py_6 = PythonScript(robot=plan_cartesian_motion.robot, group=plan_cartesian_motion.group, trajectory=plan_cartesian_motion.trajectory)  # -> start_configuration, configurations, full_configurations, frames, planes, fraction
# ---------- py_6: Python ----------
from compas_ghpython import draw_frame

joint_positions = []

if trajectory:
    configurations = trajectory.points
    start_configuration = trajectory.start_configuration
    fraction = trajectory.fraction
    time = trajectory.time_from_start
    full_configurations = [robot.merge_group_with_full_configuration(c, trajectory.start_configuration, group) for c in configurations]
    frames = [robot.forward_kinematics(c, group, options=dict(solver='model')) for c in full_configurations]
    planes = [draw_frame(frame) for frame in frames]
    P = [plane.Origin for plane in planes]
# ---------- end py_6 ----------
panel_9 = Panel(plan_cartesian_motion.out)
prismatic = QuickGraph(vis.P, SortOrder=0)
panel_10 = Panel("positions")
fraction = Panel(py_6.fraction)
scale_2 = Scale(Geometry=py_6.planes, Center=Point(0, 0, 0), Factor=0.001)  # -> Geometry, Transform
graph_5 = QuickGraph(vis.V, SortOrder=0)
graph_6 = QuickGraph(vis.A, SortOrder=0)
panel_11 = Panel("velocities")
pline = PolyLine(Vertices=scale_2.Geometry, Closed=False)
panel_12 = Panel("accelerations")
start = Button()
reset = Button()
step = Button()
counter = CountThroughList(L=py_6.full_configurations, start=start, step=step, reset=reset)  # -> item; inputs L: list, start: Boolean
# ---------- counter: Python ----------
from scriptcontext import sticky as st
from compas_ghpython.utilities import update_component


interval = 1

# store data in component
guid = str(ghenv.Component.InstanceGuid)
counter_key = "counter_" + guid
running_key = "running_" + guid

if counter_key not in st:
    st[counter_key] = 0

if running_key not in st:
    st[running_key] = False

if start:
    st[running_key] = True

if step:
    if st[counter_key] < len(L) - 1:
        st[counter_key] += 1
    
if len(L):
    item = L[st[counter_key]]

if st[running_key]:
    if st[counter_key] < len(L) - 1:
        st[counter_key] += 1
        update_component(ghenv, interval)
    else:
        st[counter_key] = 0
        st[running_key] = False
# ---------- end counter ----------
preview_2 = CustomPreview(Geometry=scale_2.Geometry, Material=ColourSwatch(SwatchColor=RGB(59, 137, 161)))

# ----
multiplication = Multiplication(A=vis.time, B=4.25)

# ---- group: cartesian motion (continued)
time_sec = Panel(multiplication)

# ----
division = Division(A=time_sec, B=60)
time_min = Panel(division)

filter_8 = StreamFilter(Gate=state, Stream0=forward_kinematics, Stream1=counter)
visualize = PythonScript(
    mode=list_12,
    robot=robot.robot,
    robot_name=robot_name,
    configuration=filter_8,
    group=main_planning_group,
    scale_factor=units,
    show_visual=show_visual,
    show_axes=show_axes,
    show_end_effector_frame=show_end_effector_frame)  # -> visual, axes, axes_color, ee_frame_vis, ee_color
# ---------- visualize: Python ----------
from System.Drawing import Color
from compas_ghpython.utilities import draw_pipes

from compas.geometry import Point
from compas.geometry import Vector
from compas.geometry import Translation

frames = []

size = .200 * scale_factor 
size_w = 2 * scale_factor 
radius = .008 * scale_factor
radius_w = .018 * scale_factor 

red = Color.FromArgb(255, 0, 0)
green = Color.FromArgb(0, 255, 0)
blue = Color.FromArgb(0, 0, 255)

frame_colors = [red, green, blue]


def pipes_from_frame(frame, size, radius): 
    pipes = []
    for axis in [frame.xaxis, frame.yaxis, frame.zaxis]:
        pipe = {}
        pipe['points'] = [list(frame.point), list(Point(*frame.point) + Vector(*axis) * size)]
        pipe['radius'] = radius
        pipes.append(pipe)
    return pipes


if robot and configuration and mode == 0:
    robot.update(configuration, visual=show_visual, collision=False)
    if show_visual:
        visual = robot.artist.draw_visual()
    if show_axes:
        pipes = []
        axes_color = []
        frames = robot.transformed_frames(configuration, group)
        for frame in frames:
            pipes += pipes_from_frame(frame, size, radius)
            axes_color += frame_colors
        axes = draw_pipes(pipes, cap=1)
    
    
    if show_end_effector_frame:
        frames = robot.transformed_frames(configuration, group)
        ee_frame = frames[8]
        print("End-effector", ee_frame)

        #Draw
        ee_pipes = pipes_from_frame(ee_frame, size, radius)
        ee_frame_vis = draw_pipes(ee_pipes, cap=1)
        ee_color = frame_colors
# ---------- end visualize ----------
preview_3 = CustomPreview(Geometry=visualize.ee_frame_vis, Shader=visualize.ee_color)
preview_4 = CustomPreview(Geometry=visualize.axes, Shader=visualize.axes_color)
preview_5 = CustomPreview(Geometry=visualize.visual, Shader=ColourSwatch(SwatchColor=RGB(105, 105, 105)))

# ==== cluster Bondary
C = ClusterInput()
bbox = BoundingBox(Content=flatten(C), Plane=PlaneXY(0, 0, 0), UnionBox=True)  # -> Box, Box_2
debrep = DeconstructBrep(Brep=bbox.Box)  # -> Faces, Edges, Vertices
item = ListItem(List=debrep.Faces, Index=Slider(3, range=0..10), Wrap=True)
rec = Rectangle(item)
boxprop = BoxProperties(Box=rec)  # -> Center, Diagonal, Area, Volume, Degeneracy
rec_2 = ClusterOutput(rec)
D = ClusterOutput(boxprop.Diagonal)

# ==== cluster PlaneAxis: show plane X Y Z axis.
P = ClusterInput()
B = ClusterInput()
deplane = DeconstructPlane(Plane=graft(P))  # -> Origin, XAxis, YAxis, ZAxis
multiplication = Multiplication(A=[deplane.XAxis, deplane.YAxis, deplane.ZAxis], B=B)
vdisex = VectorDisplayEx(
    Point=deplane.Origin,
    Vector=multiplication,
    Colour=[ColourSwatch(SwatchColor=RGB(235, 52, 52)), ColourSwatch(SwatchColor=RGB(90, 207, 48)), ColourSwatch(SwatchColor=RGB(54, 126, 227))],
    Width=2)

# ==== cluster DividebyCount
crv = ClusterInput()
N = ClusterInput()
crv_2 = Curve(crv)
divide = DivideCurve(Curve=crv_2, Count=N, Kinks=False)  # -> Points, Tangents, Parameters
frames = CurveFrames(Curve=crv_2, Count=N)  # -> Frames, Parameters
P = ClusterOutput(divide.Points)
F = ClusterOutput(frames.Frames)

# ==== cluster Axis_setting
axis_height_from_robot_base_to_axis_base = Panel("518.046")
A = ClusterInput()
subtraction = Subtraction(A=A, B=axis_height_from_robot_base_to_axis_base)
neg = Negative(Value=subtraction)
tower = Mesh(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)
Z = UnitZ(Factor=neg)
move = Move(Geometry=tower, Motion=Z)  # -> Geometry, Transform
bbox = BoundingBox(Content=move.Geometry, Plane=PlaneXY(0, 0, 0), UnionBox=True)  # -> Box, Box_2
plate_height = Panel("165")
box = EvaluateBox(Box=bbox.Box, UParameter="0", VParameter=0.5, WParameter="0")  # -> Plane, Point, Include
box_2 = EvaluateBox(Box=bbox.Box, UParameter=0.5, VParameter=0.5, WParameter="0")  # -> Plane, Point, Include
Z_2 = UnitZ(Factor=plate_height)
rümlang = Geometry(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)
rümlang_floor = Geometry(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)
x = ClusterInput()
A_2 = ClusterInput()
A_3 = ClusterInput()
box_3 = EvaluateBox(Box=rümlang_floor, UParameter=0.5, VParameter=0.5, WParameter="0")  # -> Plane, Point, Include
xy = XYPlane(Origin=box.Point)
addition = Addition(A="561.423", B=229)
neg_2 = Negative(Value=x)
geo = Geometry([rümlang, rümlang_floor])
neg_3 = Negative(Value="2000")
division = Division(A=A_2, B=2)
vec2pt = Vector2Pt(PointA=box_2.Point, PointB=box.Point, Unitize=False)  # -> Vector, Length
subtraction_2 = Subtraction(A=x, B=addition)
xy_2 = XYPlane(Origin=box.Point)
project = Project(Geometry=box_3.Point, Plane=xy)  # -> Geometry, Transform
dom = ConstructDomain(DomainStart="2000", DomainEnd=neg_3)
amp = Amplitude(Vector=vec2pt.Vector, Amplitude=subtraction_2)
rectangle = Rectangle(Plane=xy_2, XSize=dom, YSize=dom, Radius=0)  # -> Rectangle, Length
orient = Orient(Geometry=geo, Source=box_3.Point, Target=project.Geometry)  # -> Geometry, Transform
neg_4 = Negative(Value=division)
dom_2 = ConstructDomain(DomainStart=division, DomainEnd=neg_4)
Y = ClusterInput()
F = ClusterInput()
move_2 = Move(Geometry=move.Geometry, Motion=amp)  # -> Geometry, Transform
box_4 = EvaluateBox(Box=move_2.Geometry, UParameter="0", VParameter=0.5, WParameter="0")  # -> Plane, Point, Include
box_5 = EvaluateBox(Box=move_2.Geometry, UParameter=0.5, VParameter=0.5, WParameter="0")  # -> Plane, Point, Include
vec2pt_2 = Vector2Pt(PointA=box_5.Point, PointB=box_4.Point, Unitize=False)  # -> Vector, Length
move_3 = Move(Geometry=box_4.Point, Motion=Z_2)  # -> Geometry, Transform
amp_2 = Amplitude(Vector=vec2pt_2.Vector, Amplitude=A_3)
move_4 = Move(Geometry=move_3.Geometry, Motion=amp_2)  # -> Geometry, Transform
yz = YZPlane(Origin=move_4.Geometry)
boundary = BoundarySurfaces(Edges=rectangle.Rectangle)
Y_2 = UnitY(Factor=F)
rectangle_2 = Rectangle(Plane=yz, XSize=dom_2, YSize=Y, Radius=0)  # -> Rectangle, Length
move_5 = Move(Geometry=rectangle_2.Rectangle, Motion=Y_2)  # -> Geometry, Transform
X = UnitX(Factor=Slider(700, range=0..1000))
G = ClusterInput()
X_2 = UnitX(Factor=Slider(460, range=0..1000))
geo_2 = Geometry([move_2.Geometry, orient.Geometry])
geo_3 = Geometry([move_2.Geometry, boundary])
neg_5 = Negative(Value=X)
geo_4 = Geometry(move_5.Geometry)
filter = StreamFilter(Gate=G, Stream0=geo_3, Stream1=geo_2)
mesh = MeshBrep(
    Brep=geo_4,
    Settings={GridMaxCount=0, GridMinCount=16, JaggedSeams=False, MaxEdgeLength=0, MinEdgeLength=0.0001, MinTolerance=0, Refine=True, RefineAngle=0, RelativeTolerance=0.65, SimplePlanes=True, Tolerance=0})
move_6 = Move(Geometry=geo_4, Motion=[X_2, neg_5])  # -> Geometry, Transform
geo_5 = Geometry(filter)
targetmesh = ClusterOutput(mesh)
loft = Loft(Curves=move_6.Geometry, Options={Adjust=False, Closed=False, LoftEnds=0, LoftSimp=0, LoftType=0, Rebuild=10, Refit=0.01})
env = ClusterOutput(geo_5)
cap = CapHoles(Brep=loft)
boundingbox = ClusterOutput(cap)

# ==== cluster Color
M = ClusterInput()
clean = CombineClean(Meshes=M)
mesh = Mesh(clean)
demesh = DeconstructMesh(Mesh=mesh)  # -> Vertices, Faces, Colours, Normals
lng = ListLength(List=demesh.Vertices)
pdecon = Deconstruct(Point=demesh.Vertices)  # -> XComponent, YComponent, ZComponent
series = Series(Start=0, Step=1, Count=lng)
far = ColourSwatch(SwatchColor=RGB(255, 0, 0))
close = ColourSwatch(SwatchColor=RGB(13, 0, 255))
mid = ColourSwatch(SwatchColor=RGB(255, 247, 0))
sort = SortList(Keys=pdecon.XComponent, ValuesA=series)  # -> Keys, ValuesA
range = Range(Domain=Domain(0, 1), Steps=lng)
cull_i = CullIndex(List=range, Indices=0, Wrap=True)
col = Colour([far, mid, close])
interp = InterpolateData(Data=col, Parameter=cull_i, Interpolation=2)
sort_2 = SortList(Keys=sort.ValuesA, ValuesA=interp)  # -> Keys, ValuesA
mcol = MeshColours(Mesh=mesh, Colours=sort_2.ValuesA)
mesh_2 = Mesh(mcol)
mesh_3 = ClusterOutput(mesh_2)

# ==== cluster Process_mesh
pt = ClusterInput()
G = ClusterInput()
pt_2 = Point(pt)
xy = XYPlane(Origin=Point(0, 0, 0))
yz = YZPlane(Origin=pt_2)
scale = Scale(Geometry=G, Center=Point(0, 0, 0), Factor=1000)  # -> Geometry, Transform
rad = Radians(Degrees=-90)
deplane = DeconstructPlane(Plane=xy)  # -> Origin, XAxis, YAxis, ZAxis
box = ClusterInput()
rot3d = Rotate3D(Geometry=xy, Angle=rad, Center=Point(0, 0, 0), Axis=deplane.ZAxis)  # -> Geometry, Transform
orient = Orient(Geometry=rot3d.Geometry, Source=rot3d.Geometry, Target=yz)  # -> Geometry, Transform
box_2 = Box(box)
transform = Transform(Geometry=scale.Geometry, Transform=orient.Transform)
mesh = Mesh(transform)
msplit = MeshSplit(Mesh=mesh, Splitters=box_2)
area = Area(Geometry=msplit)  # -> Area, Centroid
volume = Volume(Geometry=box_2)  # -> Volume, Centroid
dist = Distance(PointA=graft(area.Centroid), PointB=volume.Centroid)  # -> flatten(Distance)
sort = SortList(Keys=dist, ValuesA=msplit)  # -> Keys, ValuesA
item = ListItem(List=sort.ValuesA, Index=0, Wrap=True)
clean = CombineClean(Meshes=item)
mesh_2 = Mesh(clean)
demesh = DeconstructMesh(Mesh=mesh_2)  # -> Vertices, Faces, Colours, Normals
lng = ListLength(List=demesh.Vertices)
pdecon = Deconstruct(Point=demesh.Vertices)  # -> XComponent, YComponent, ZComponent
series = Series(Start=0, Step=1, Count=lng)
far = ColourSwatch(SwatchColor=RGB(255, 0, 0))
close = ColourSwatch(SwatchColor=RGB(13, 0, 255))
mid = ColourSwatch(SwatchColor=RGB(255, 247, 0))
sort_2 = SortList(Keys=pdecon.XComponent, ValuesA=series)  # -> Keys, ValuesA
range = Range(Domain=Domain(0, 1), Steps=lng)
cull_i = CullIndex(List=range, Indices=0, Wrap=True)
col = Colour([far, mid, close])
interp = InterpolateData(Data=col, Parameter=cull_i, Interpolation=2)
sort_3 = SortList(Keys=sort_2.ValuesA, ValuesA=interp)  # -> Keys, ValuesA
mcol = MeshColours(Mesh=mesh_2, Colours=sort_3.ValuesA)
M = ClusterOutput(mcol)

# ==== cluster Volume
G = ClusterInput()
volume = Volume(Geometry=G)  # -> Volume, Centroid
abs = Absolute(Value=volume.Volume)
division = Division(A=abs, B=1000000000)
R = ClusterOutput(division)
