# Grasshopper definition 210129_T2_master_weiting.ghx (Grasshopper 1.0.7)
# plug-ins: Kangaroo2 Components

# STEP 2: Make a selection from all the recorded points
# STEP 2: Make a selection from all the recorded points
stored_controllerpoints_curvy = Point([Point(-0.001054746486, 0.3533248491, 2.048906329), Point(0.002328803356, 0.3829075946, 1.980583426), Point(0.01141501161, 0.4020760754, 1.965274916), Point(0.02268088363, 0.42493331, 1.956116594), Point(0.03520617572, 0.4529772634, 1.952002765), Point(0.03520617572, 0.4529772634, 1.952002765)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])
# STEP 1: raw points / planes
stored_controllerpoints = Point([Point(0.01380643666, 0.4999106253, 2.24500093), Point(0.01678736156, 0.5284045235, 2.249311734), Point(0.0397521491, 0.5850090184, 2.218940561), Point(0.0500757712, 0.6078811493, 2.193464728), Point(0.05752233544, 0.6257740866, 2.166966741), Point(0.06201127194, 0.6543702233, 2.105465321)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])
stored_controllerframes = Plane([Plane(origin=(0.01380643666, 0.4999106253, 2.24500093), x=(-0.6840319334, -0.03730985888, 0.728497281), y=(0.030590718, 0.9963452988, 0.07975119741)), Plane(origin=(0.01678736156, 0.5284045235, 2.249311734), x=(-0.6893548654, 0.007249260085, 0.7243875467), y=(-0.03253892195, 0.9986308516, -0.04095901299)), Plane(origin=(0.0397521491, 0.5850090184, 2.218940561), x=(-0.5035927766, 0.1459907667, 0.8515168885), y=(-0.1587722478, 0.9531929617, -0.2573218821)), Plane(origin=(0.0500757712, 0.6078811493, 2.193464728), x=(-0.373280077, 0.2521984748, 0.8927809997), y=(-0.2158392547, 0.9123238651, -0.3479634771)), Plane(origin=(0.05752233544, 0.6257740866, 2.166966741), x=(-0.2158613291, 0.2287619635, 0.9492480449), y=(-0.2757960222, 0.9182969992, -0.2840196743)), Plane(origin=(0.06201127194, 0.6543702233, 2.105465321), x=(0.1986286681, -0.01368302314, 0.9799792993), y=(-0.2601170387, 0.9633069761, 0.06617247185))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])
# SYNTHESIZER - SET UP
panel = Panel("")

# ----
# RECORDING - SET UP
panel_2 = Panel("Unload libraries")
bang = Button()
python = GhPythonScript()  # -> DATA
# ---------- python: Python ----------
import os

HERE = os.path.dirname(ghdoc.Path)
DATA = os.path.abspath(os.path.join(HERE, "..", "data"))

print (DATA)
# ---------- end python ----------
unload = PythonScript(bang=bang)
# ---------- unload: Python ----------
from compas_rhino.utilities.misc import get_tolerance
from compas_rhino.utilities.misc import unload_modules

unload_modules("compas")
unload_modules("compas_fab")
unload_modules("ur_online_control")
unload_modules("intuitive_design")
# ---------- end unload ----------

# ----
# From a recorded data set, first we want to process the data set minimally. We store this in a class so that we always have access to the original recorded data set.
curve_start = Slider(0.135, range=0..1)
curve_end = Slider(1, range=0..1)
curve_length = Slider(0.626, range=0..1)

# ----
# ROS - Settings
list = ValueList({"local": 0, "remote laptop": 1}, selected="local")
restart = Button()
connect = Button()
disconnect = Button()
ros = PythonScript(restart=restart, connection=list)  # -> out, ros_client
# ---------- ros: Python ----------
import time
import logging
import scriptcontext as sc

from roslibpy import Ros
from System import TimeSpan
from System.Threading import ManualResetEventSlim

LOGGER = logging.getLogger('roslibpy')


guid = str(ghenv.Component.InstanceGuid)
ros_client_key = "rosclient_" + guid

previous_client = sc.sticky.get(ros_client_key, None)
if previous_client:
    previous_client.terminate()

if connection == 0: #local
    ros_client = Ros('127.0.0.1', 9090) #local, own laptop
elif connection == 1: # backpack computer
    ros_client = Ros('192.168.2.100', 9090) 
sc.sticky[ros_client_key] = ros_client

waitLock = ManualResetEventSlim(False) 
ros_client.on_ready(lambda: waitLock.Set()) 

if not waitLock.Wait(TimeSpan.FromSeconds(5)):
    raise Exception('Unable to connect to ROS')

LOGGER.info('ROS connection opened')


    #out = "no ROS connection found"
# ---------- end ros ----------
connect_2 = PythonScript(ros_client=ros.ros_client, connect=connect, disconnect=disconnect)  # -> out, ros_client
# ---------- connect_2: Python ----------
import logging
from System import TimeSpan
from System.Threading import ManualResetEventSlim

LOGGER = logging.getLogger('roslibpy')

if connect:
    if not ros_client.is_connected:
        LOGGER.debug('Connecting...')
        waitLock = ManualResetEventSlim(False)
        ros_client.on_ready(lambda: waitLock.Set())
        ros_client.connect()

        if not waitLock.Wait(TimeSpan.FromSeconds(5)):
            raise Exception('Unable to connect to ROS')
        LOGGER.debug('Reconnected')

if disconnect:
    if ros_client.is_connected:
        ros_client.terminate()
        LOGGER.debug('Terminated')
        
       
if (ros_client.is_connected):
    print('connected')
else:
    print('disconnected')
# ---------- end connect_2 ----------
panel_3 = Panel(ros.out)
panel_4 = Panel(connect_2.out)

# ----
# Publisher
button = Button()
# 1: Set up and check the IP of the ROS-master
# 
# 2: double check the topic-name you want to listen to
# 
# 3: double check the topic-name you want to publish
number_slider = Slider(548, range=0..548)
stored_controllerpoints_2 = Point([Point(-0.001054746486, 0.3533248491, 2.048906329), Point(0.002328803356, 0.3829075946, 1.980583426), Point(0.01141501161, 0.4020760754, 1.965274916), Point(0.02268088363, 0.42493331, 1.956116594), Point(0.03520617572, 0.4529772634, 1.952002765), Point(0.03520617572, 0.4529772634, 1.952002765)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])
dom = ConstructDomain(DomainStart=0, DomainEnd=number_slider)
timer = Timer(TimerInterval=100, Target=publish)  # disabled
subset = SubList(List=stored_controllerpoints_2, Domain=dom, Wrap=True)  # -> List, Index
publish = PythonScript(ros_client=ros.ros_client, publish_to_topic=button, point=subset.List)  # -> out; inputs publish_to_topic: Boolean, point: list of Point3d
# ---------- publish: Python ----------
import time
import logging
import datetime
import Grasshopper
from roslibpy import Topic
from scriptcontext import sticky


points= [[p.X, p.Y, p.Z] for p in point]


def publish_new_curve():
    pose_array = []
    idx_array = []
    add_objects = []
    points= [[p.X, p.Y, p.Z] for p in point]
    for i,p in enumerate(points):
        idx = i
        pos_x = p[0]
        pos_y = p[1]
        pos_z = p[2]
        qx = 1
        qy = 0
        qz = 2
        qw = 3
        pose_array.append({'position': {'x': pos_x, 'y': pos_y, 'z': pos_z}, 'orientation': {'x': qx, 'y': qy, 'z': qz, 'w': qw}})
        add_objects.append({'header':{'seq': 0, 'stamp':{'secs': 0, 'nsecs': 0}, 'frame_id': idx}, 'pose': {'position': {'x': pos_x, 'y': pos_y, 'z': pos_z}, 'orientation': {'x': qx, 'y': qy, 'z': qz, 'w': qw}}})
        idx_array.append(idx)
    return add_objects, pose_array

if publish_to_topic:
    print("send")
    if ros_client:
            print("publishing")
            publisher_objects = Topic(ros_client, '/rhino/new_point_poses', 'geometry_msgs/PoseArray')
            pose_array = []
            message= publisher_objects.publish({'header': {'seq': 0, 'stamp': 1111 , 'frame_id': '/world'}, 'poses': publish_new_curve()[1]})
# ---------- end publish ----------

# ----
# Listener
subscribe_to_topic = BooleanToggle(True)
subscribe = PythonScript(ros_client=ros.ros_client, subscribe_to_topic=subscribe_to_topic)  # -> out; inputs subscribe_to_topic: Boolean
# ---------- subscribe: Python ----------
import time
import logging
import datetime
import Grasshopper
from roslibpy import Topic
from scriptcontext import sticky

LOGGER = logging.getLogger('roslibpy')
key_pose = 'listener_key_pose'
listener_key_button = 'listener_key_button'
controller_pose = 'listener_key_controller'
lighthouse1 = 'listener_key_lighthouse1'
lighthouse2 = 'listener_key_lighthouse2'

if subscribe_to_topic:
    if ros_client and ros_client.is_connected:
        listener_pose = Topic(ros_client, '/tf', 'tf2_msgs/TFMessage')
        listener_pose_controller = Topic(ros_client, '/frame_controller', 'geometry_msgs/PoseStamped')
        listener_pose_lighthouse1 = Topic(ros_client, '/frame_lighthouse1', 'geometry_msgs/PoseStamped')
        listener_pose_lighthouse2 = Topic(ros_client, '/frame_lighthouse2', 'geometry_msgs/PoseStamped')
        listener_button = Topic(ros_client, '/vive/controller_LHR_FF7A7BC1/joy', 'sensor_msgs/Joy') 
        sticky[key_pose] = listener_pose
        sticky[listener_key_button] = listener_button
        sticky[controller_pose] = listener_pose_controller
        sticky[lighthouse1] = listener_pose_lighthouse1
        sticky[lighthouse2] = listener_pose_lighthouse2
        print ("listening")
    else:
        sticky[key_pose] = None
        sticky[listener_key_button] = None
        sticky[controller_pose] = None
        sticky[lighthouse1] = None
        sticky[lighthouse2] = None
else:
    sticky[key_pose] = None
    sticky[listener_key_button] = None
    sticky[controller_pose] = None
    sticky[lighthouse1] = None
    sticky[lighthouse2] = None
# ---------- end subscribe ----------
panel_5 = Panel(subscribe)

panel_6 = Panel(stored_controllerframes)
dcon = DeleteConsecutive(Set=stored_controllerpoints, Wrap=False)  # -> Set, Count
make_point_selection = GhPythonScript(
    allpoints=dcon.Set,
    storedframes=stored_controllerframes,
    start=curve_start,
    end=curve_end,
    domainLength=curve_length,
    run=Button())  # -> filterpoints, usablePoints, usablePointCurve, pointsetRandom, pointsetRandom_constantLength; inputs allpoints: list of Point3d, storedframes: list of Plane
# ---------- make_point_selection: Python ----------
from intuitive_design.scan_data import scanData

if __name__ == "__main__":

    #instantiate point class
    filterpoints = scanData(storedframes, allpoints)
    #in case we just have frames update the allpoints
    filterpoints.storeAllPoints()

    # trim the edges to clean up the curve, check in preview
    usablePoints, usablePointCurve = filterpoints.storePointSelection(start, end) 

    pointsetRandom = filterpoints.generateRandomSelection()
    
    pointsetRandom_constantLength = filterpoints.generateRandomSelection_similarLength(domainLength)
# ---------- end make_point_selection ----------
panel_7 = Panel(ros.ros_client)
pt = Point(make_point_selection.pointsetRandom_constantLength)
pt_2 = Point(make_point_selection.usablePoints)
crv = Curve(make_point_selection.usablePointCurve)
pt_3 = Point(make_point_selection.pointsetRandom)
Y = UnitY(Factor=expr("-1*x", 1))
Z = UnitZ(Factor=1)
# A reference geometry is important because it gives information about how our recorded geometry should relate to a new geometric condition.. we can either use curves or Planes.. this will enable more control when we want to apply the paths to a larger geometric condition
pt_4 = Point(<point referenced from the Rhino model>)
# STEP 3: Assign cleaned up curves to a reference geometry
pl = ConstructPlane(Origin=pt_4, XAxis=Y, YAxis=Z)
u_value_surface = Slider(0.183, range=0..1)
v_value_surface = Slider(0.824, range=0..1)

stop_timer = Button()
start_timer = Button()
bang_2 = Button()
listening = GhPythonScript(bang=bang_2, start_timer=start_timer, stop_timer=stop_timer)  # -> out, buttons, axes, controller, lighthouse1, lighthouse2
# ---------- listening: Python ----------
from scriptcontext import sticky
from compas_ghpython.utilities import update_component
from compas.geometry import Frame
from compas.geometry import Transformation
import rhinoscriptsyntax as rs
from intuitive_design.capture_data import Sensordata
#from intuitive_robotic_fabrication..ros_connection import Sensordata


guid = str(ghenv.Component.InstanceGuid) 

device = Sensordata(buttons)
lighthouse_one = Sensordata(buttons)
lighthouse_two = Sensordata(buttons)

timer_running_key = "timer_running_" + guid
counter_key = "counter_" + guid


if stop_timer or timer_running_key not in sticky:
    sticky[timer_running_key] = False
    sticky[counter_key] = 0

if start_timer:
    sticky[timer_running_key] = True
    sticky[counter_key] = 0

if sticky[timer_running_key]:
    update_component(ghenv, 10)
    sticky[counter_key] += 1
    print(sticky[counter_key])


def receive_controller_buttons(message_buttons):
    sticky['controller_buttons'] = message_buttons

def receive_controller_pose(message_pose):
    sticky['controller_pose'] = message_pose

def receive_lighthouse1_pose(message_pose):
    sticky['lighthouse1'] = message_pose
    
def receive_lighthouse2_pose(message_pose):
    sticky['lighthouse2'] = message_pose
    
    
if 'listener_key_button' in sticky and sticky['listener_key_button'] is not None:
    listener_key_button = sticky['listener_key_button']
    listener_key_button.subscribe(receive_controller_buttons)
    
    if 'controller_buttons' in sticky and sticky['controller_buttons']:
        controller_name, axes, buttons= Sensordata.contr_buttons(device)
        print ("Active Controller Name: " + str(controller_name))
        print ("Pressed Buttons: " + str(buttons) + (", ") + "Pressed Axes: " + str(axes))

if 'listener_key_controller' in sticky and sticky['listener_key_controller'] is not None:
    listener_key_controller = sticky['listener_key_controller']
    listener_key_controller.subscribe(receive_controller_pose)
    
    if 'controller_pose' in sticky and sticky['controller_pose']:
        c_pose = sticky['controller_pose']
        frame_id = c_pose['header']['frame_id']
        controller = Sensordata.pose_calc_posestamped(device, c_pose)
        #controller_pose = rs.PlaneFromFrame(controller[0], controller[1], controller[2])

if 'listener_key_lighthouse1' in sticky and sticky['listener_key_lighthouse1'] is not None:
    listener_key_lighthouse1 = sticky['listener_key_lighthouse1']
    listener_key_lighthouse1.subscribe(receive_lighthouse1_pose)
    
    if 'lighthouse1' in sticky and sticky['lighthouse1']:
        l1_pose = sticky['lighthouse1']
        lighthouse1 = Sensordata.pose_calc_posestamped(lighthouse_one, l1_pose)

if 'listener_key_lighthouse2' in sticky and sticky['listener_key_lighthouse2'] is not None:
    listener_key_lighthouse2 = sticky['listener_key_lighthouse2']
    listener_key_lighthouse2.subscribe(receive_lighthouse2_pose)

    if 'lighthouse2' in sticky and sticky['lighthouse2']:
        l2_pose = sticky['lighthouse2']
        lighthouse2 = Sensordata.pose_calc_posestamped(lighthouse_two, l2_pose)


else:
    print('NOT listening, - ROS Master might not be connected ')
# ---------- end listening ----------
reset = Button()
export = Button()
panel_8 = Panel(listening.out)
transformation = GhPythonScript(
    controller=listening.controller,
    lighthouse_frame=listening.lighthouse1,
    lighthouse2_frame=listening.lighthouse2,
    PATH=python,
    reset=reset,
    export_to_json=export,
    Run=Toggle(True))  # -> out, l2_plane, l_plane, t_plane, frame_list, point_list
# ---------- transformation: Python ----------
from scriptcontext import sticky
import compas.geometry as cg
import rhinoscriptsyntax as rs
from intuitive_design.capture_data import Sensordata


if "controller_frame" not in globals():
    controller_frame = []
    points = []
    
if reset:
    controller_frame = []
    points = []
    print "initializing" 

dict = {}

controller_points = Sensordata('buttons')
lighthouse_points = Sensordata('buttons')
lighthouse2_points = Sensordata('buttons')

try:
    l_frame, l_origin = lighthouse_points.transform_pose_list(lighthouse_frame)
    l_plane = rs.PlaneFromFrame(l_frame[0], l_frame[1], l_frame[2])
    
    l2_frame, l2_origin = lighthouse2_points.transform_pose_list(lighthouse2_frame)
    l2_plane = rs.PlaneFromFrame(l2_frame[0], l2_frame[1], l2_frame[2])
    
    t_frame, t_origin = controller_points.transform_pose_list(controller)
    t_plane = rs.PlaneFromFrame(t_frame[0], t_frame[1], t_frame[2])

except:
    pass
    
if Run:

    if t_plane != None:
       controller_frame.append(t_plane)
       points.append(rs.coerce3dpoint(t_origin))


frame_list = controller_frame
point_list = points


#////////////////////////////////////////////////////

if export_to_json:
    for i,frame in enumerate(frame_list):
        dict[i] = {'point': str(frame.Origin), 'xAxis': str(frame.XAxis), 'YAxis': str(frame.YAxis)}
    controller_points.save_to_json(dict, PATH)
# ---------- end transformation ----------
stored_controllerframes_2 = Plane(transformation.frame_list)
stored_controllerpoints_3 = Point(transformation.point_list)
realtime_controller = Plane(transformation.t_plane)
realtime_controller_2 = Plane([transformation.l_plane, transformation.l2_plane])

list_2 = ValueList({"plane from a curve": 0, "get plane from a surface": 1, "predefined plane": 2}, selected="plane from a curve")
curve_start_2 = Slider(0.521, range=0..1)
spraying_surface = Surface(reparameterize(<surface referenced from the Rhino model>))
reference_curve = Curve(<curve referenced from the Rhino model>)
X = UnitX(Factor=1)
pln = Plane(pl)
python_2 = GhPythonScript(
    filterpoints=make_point_selection.filterpoints,
    refPlane=pln,
    refCurve=reference_curve,
    refVector=X,
    plane_index=curve_start_2,
    surface=spraying_surface,
    uvalue=u_value_surface,
    vvalue=v_value_surface,
    method=list_2)  # -> out, filterpoints, plane, plane_srf; inputs refPlane: Plane, refCurve: Curve, refVector: Vector3d, surface: Surface
# ---------- python_2: Python ----------
import rhinoscriptsyntax as rs
import Rhino.Geometry as rg 
import intuitive_design.utilities.util as u


def getPlaneFromCurveTangentRefVec(tangent, refZVector, point):
    newVec = rg.Vector3d.CrossProduct(tangent, refZVector)
    newPlane = rg.Plane(point, tangent, newVec)
    return newPlane

def getPlanefromPlanelist(planes):
        index = plane_index
        p_index = int(index * len(planes))-1
        plane = planes[p_index]
        return plane
        
def getPlanefromSurface(surface, uvalue, vvalue):
    plane = rg.Surface.FrameAt(surface, uvalue, vvalue)
    return plane[1]
    
#there are different methods to find a plane to reference your geometry to
if method == 0:
    planes = u.getPlanesFromCurves(refCurve, 0.1, refVector)
    plane = getPlanefromPlanelist(planes)

if method == 1:
    plane = getPlanefromSurface(surface, uvalue, vvalue)
    
if method == 2:
    plane = refPlane
    
filterpoints.addReferenceGeometry_Plane(plane)
# ---------- end python_2 ----------
pln_2 = Plane(python_2.plane)
pln_3 = Plane(python_2.plane_srf)
panel_9 = Panel(pln_3)

# ----
# Controller_control:
number_slider_2 = Slider(1, range=0..10)
controller_trigger = ListItem(List=listening.buttons, Index=number_slider_2, Wrap=True)
controller_delete = ListItem(List=listening.buttons, Index=Slider(0, range=0..10), Wrap=True)

panel_10 = Panel("goal plane")
Y_2 = UnitY(Factor=expr("-1*x", 1))
Z_2 = UnitZ(Factor=1)
pt_5 = Point(<point referenced from the Rhino model>)
pl_2 = ConstructPlane(Origin=pt_5, XAxis=Y_2, YAxis=Z_2)
pln_4 = Plane(pl_2)

# ----
# STEP 4: Stylized filter : Develop methods of rebuilding curves
# Now we want to be able to apply affects or "filters" to many of our filtered geometries on a curves.
Y_3 = UnitY(Factor=1)
python_3 = GhPythonScript(
    filterpoints=python_2.filterpoints,
    plane=pln_4,
    offset_vector=Y_3,
    distance=Slider(0.05293, range=0..1),
    rebuild_percentage=Slider(22, range=0..100),
    degree=Slider(2, range=1..3),
    offset=Toggle(True),
    scale=Slider(848, range=0..1000),
    offset_amount_multiple_crvs=Slider(-43, range=-100..100))  # -> out, filtered_pointlist, points_transformed, original_points, new_curve, offset_curves; inputs offset_vector: Vector3d, degree: Int32
# ---------- python_3: Python ----------
import rhinoscriptsyntax as rs
import Rhino.Geometry as rg
import compas.geometry as cg
from intuitive_design.scan_data import scanData
import intuitive_design.utilities.util as u
from intuitive_design.design_filter import filters_BaseClass
from intuitive_design.design_filter import filter_offset

offset_curves = []
f = filters_BaseClass(filterpoints, plane)
f.scale(scale, scale, scale)
f.transform_points_plane()

points_transformed = f.pointsTransformed
original_points = filterpoints.usablePointSet
new_curve = u.makeCurveFromPoints(points_transformed)

if offset:
    offset_crv = filter_offset(filterpoints, points_transformed)
    #new_curve, new_points = offset_crv.offset_points(offset_vector=offset_vector, distance=distance, degree=degree, rebuild_percentage=rebuild_percentage)
    
    for i in range(3):
        new_curve, new_points = offset_crv.offset_points(offset_vector=offset_vector, distance=distance+(i*offset_amount_multiple_crvs), degree=degree, rebuild_percentage=rebuild_percentage)
        offset_curves.append(rs.coercecurve(new_curve))
        

filtered_pointlist = f
# ---------- end python_3 ----------
crv_2 = Curve(python_3.new_curve)
pt_6 = Point(python_3.original_points)
pt_7 = Point(python_3.points_transformed)
crv_3 = Curve(python_3.offset_curves)
# STEP 5: Apply curves to geometry / multiply geometries
# Now we want to be able to apply affects or "filters" to many of our filtered geometries on a curves.
panel_11 = Panel(python_3.out)

move_axis_in_z = Slider(177, range=0..2000)
move_target_mesh_in_y = Slider(187, range=-500..500)
distance_from_axis_to_target_mesh = Panel("1300")
move_axis_in_x = Slider(671, range=0..1000)
target_mesh_height = Panel("1800")
rümlang_robot_positions = Geometry([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])
target_mesh_width = Panel("1250")
list_3 = ValueList({"RFL": 0, "Rümlang": 1}, selected="RFL")
axis_setting = Axis_setting(
    G=list_3,
    x=move_axis_in_x,
    A=move_axis_in_z,
    Y=target_mesh_height,
    A_3=distance_from_axis_to_target_mesh,
    F=move_target_mesh_in_y,
    A_2=target_mesh_width)  # -> env, targetmesh, boundingbox
preview = CustomPreview(Geometry=axis_setting.env, Shader=ColourSwatch(SwatchColor=RGBA(166, 166, 166, 45)))
mesh = Mesh(axis_setting.targetmesh)

# ----
# Read JSON
panel_12 = Panel("210128_2m_Panel_Curve2_Fabrication_Parameters.json")
py = GhPythonScript()  # -> json_source
# ---------- py: Python ----------
import os
import sys

filepath = ghenv.Component.Attributes.Owner.OnPingDocument().FilePath
path = os.path.abspath(os.path.join(filepath, "..", "..", ".."))
print(path)

json_source = os.path.abspath(os.path.join(path, "data/json/210128_Group_1_Panel_2"))
# ---------- end py ----------
panel_13 = Panel(py)
read = GhPythonScript(
    file_path=panel_13,
    fab_parameters_filename=panel_12,
    mesh_filename="210128_2m_Panel_Base_Mesh_14.json",
    load_mesh=Toggle(False),
    load_fab_parameters=Toggle(True),
    reverse_vol=Toggle(False))  # -> out, mesh, close_mesh, target_pts_out, velocity_list_out, Ed_list_out, overall_setting_out; inputs load_mesh: Boolean, reverse_vol: Boolean
# ---------- read: Python ----------
import os
import json
import Rhino.Geometry as rg
import ghpythonlib.treehelpers as th
from compas.datastructures import Mesh
from compas_ghpython.artists import MeshArtist
from robotic_plaster_spraying.utilities_fabrication import data_gathering
reload(data_gathering)
from robotic_plaster_spraying.utilities_fabrication import projection
reload(projection)

if load_mesh:
    c_mesh = Mesh.from_json(os.path.join(file_path, mesh_filename))

    artist = MeshArtist(c_mesh)
    mesh = artist.draw()
    
    close_mesh = projection.CapMesh(c_mesh, reverse = reverse_vol)
    
    artist = MeshArtist(close_mesh)
    close_mesh = artist.draw()

if load_fab_parameters:
    fabrication_parameters = data_gathering.ReadDictFromJson(os.path.join(file_path, fab_parameters_filename))
    
    path = []
    velocity_list = []
    Ed_list = []
    overall_setting = []
    
    for i in range(len(fabrication_parameters)):
        branch = []
        Ed = []
        velocity = []
        for j in range(len(fabrication_parameters['%d' % i])):
            if i == 0 and j == 0:
                overall_setting.extend([fabrication_parameters['%d' % i]['%d' % j]['pump_speed'],
                                        fabrication_parameters['%d' % i]['%d' % j]['air_pressure'],
                                        fabrication_parameters['%d' % i]['%d' % j]['custom_layer_num']
                                       ])
                branch.append(rg.Point3d(*fabrication_parameters['%d' % i]['%d' % j]['xyz']))
                Ed.append(fabrication_parameters['%d' % i]['%d' % j]['Ed'])
                velocity.append(fabrication_parameters['%d' % i]['%d' % j]['velocity'])
            else:
                
                branch.append(rg.Point3d(*fabrication_parameters['%d' % i]['%d' % j]['xyz']))
                Ed.append(fabrication_parameters['%d' % i]['%d' % j]['Ed'])
                velocity.append(fabrication_parameters['%d' % i]['%d' % j]['velocity'])
        
        path.append(branch)
        Ed_list.append(Ed)
        velocity_list.append(velocity)
        
    target_pts_out = th.list_to_tree(path)
    velocity_list_out = th.list_to_tree(velocity_list)
    Ed_list_out = th.list_to_tree(Ed_list)
    overall_setting_out = th.list_to_tree(overall_setting)
# ---------- end read ----------
color = Color(M=read.mesh)
mesh_2 = Mesh(read.close_mesh)
pt_8 = Point(read.target_pts_out)
volume = Volume(G=mesh_2)
volume_m3 = Panel(volume)

# ----
# Edited_Curve
crv_4 = Curve()

# ----
# No Scan
number_slider_3 = Slider(6, range=0..10)
mesh_3 = Mesh(mesh)
build = GhPythonScript(mesh=mesh_3, level=number_slider_3)  # -> out, mesh; inputs mesh: Mesh, level: Int32
# ---------- build: Python ----------
from robotic_plaster_spraying.utilities_fabrication.projection import RhinoToCompasMesh
from compas.datastructures import mesh_subdivide_quad
from compas_ghpython.artists import MeshArtist

c_mesh = RhinoToCompasMesh(mesh)
subd_mesh = mesh_subdivide_quad(c_mesh, k = level)

### Rhino mesh ###
mesh = MeshArtist(subd_mesh)
mesh = mesh.draw()
# ---------- end build ----------
clean = CombineClean(Meshes=build.mesh)
area = Area(Geometry=clean)  # -> Area, Centroid
scale = Scale(Geometry=clean, Center=area.Centroid, Factor=Slider(1.1, range=0..10))  # -> Geometry, Transform

# ----
# Bound of Ed
panel_14 = Panel("300")
dom_2 = ConstructDomain(DomainStart=panel_14, DomainEnd="500")

angles_group_1 = Data(Tree({0}: ["20", "20", "20", "20", "20", "20", "20", "20"], {1}: ["10", "10", "10", "10", "10", "10", "10", "10", "10", "10", "10", "10", "10", "10", "10", "10", "10", "10", "10", "10", "10", "10", "10", "10", "10", "10", "10", "10", "10", "10", "10", "10", "10", "10", "10", "10", "10", "10", "10", "10", "10", "10", "10", "10", "10", "10", "10", "10", "10", "10", "10", "10", "10", "10", "10", "10", "10", "10", "10", "10"], {2}: ["5", "5", "5", "5", "5", "5", "5", "5", "5", "5", "5", "5", "5", "5", "5", "5", "5", "5", "5", "5", "5", "5", "5", "5", "5", "5", "5", "5", "5", "5", "5", "5", "5", "5", "5", "5", "5", "5", "5", "5", "5", "5", "5", "5", "5", "5", "5", "5", "5", "5", "5", "5", "5"], {3}: ["0", "0", "0", "0", "0", "0", "0", "0", "0", "0", "0", "0", "0", "0", "0", "0", "0", "0", "0", "0", "0", "0", "0", "0", "0", "0", "0", "0", "0", "0", "0", "0", "0", "0", "0", "0", "0", "0", "0", "0", "0", "0", "0"], {4}: ["-5", "-5", "-5", "-5", "-5", "-5", "-5", "-5", "-5", "-5", "-5", "-5", "-5", "-5", "-5", "-5", "-5", "-5", "-5", "-5", "-5", "-5", "-5", "-5", "-5", "-5", "-5", "-5", "-5", "-5", "-5", "-5", "-5"], {5}: ["-15", "-15", "-15", "-15", "-15", "-15", "-15", "-15", "-15", "-15", "-15", "-15", "-15", "-15", "-15", "-15", "-15", "-15", "-15", "-15", "-15", "-15", "-15"], {6}: ["-20", "-20", "-20", "-20", "-20", "-20", "-20", "-20", "-20", "-20", "-20", "-20", "-20"]))
angles_group_2 = Data(Tree({0}: [0, 0, 0, 0, 0, 0, 0, 0, 0, 0, 0, 0, 0, 0, 0, 0, 0, 0, 0, 0, 0, 0, 0, 0, 0, 0], {1}: [0, 0, 0, 0, 0, 0, 0, 0, 0, 0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], {2}: [0, 0, 0, 0, 0, 0, 0, 0, 0, 0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], {3}: [0, 0, 0, 0, 0, 0, 0, 0, 0, 0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], {4}: [0, 0, 0, 0, 0, 0, 0, 0, 0, 0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], {5}: [0, 0, 0, 0, 0, 0, 0, 0, 0, 0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], {6}: [-20, -19.51219512, -19.02439024, -18.53658537, -18.04878049, -17.56097561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], {7}: [20, 19.29824561, 18.59649123, 17.89473684, 17.19298246, 16.49122807, 15.78947368, 15.0877193, 14.38596491, 13.68421053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]))

# ----
# Robot Simulation
# Fabrication Setup
# ROS Connection
# Load Robot from urdf
# Velocity and Ed
# Target Geometry
# Branch
# Target Planes
# Velocity
# Ed
# Layer number
# Custom Layer number
# Base Mesh
# Process Control
# Camera Position
# Transformed Mesh
# Projection Direction
multiple_filtered_curves = Curve(Tree({0;0;0;0;0;0}: [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], {0;0;0;0;0;1}: [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], {0;0;0;0;0;2}: [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]))
_201211_2m_panel = Curve(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)
_201215_3m_panel = Curve(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)
_201218_3m_panel = Curve([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])
_201222_2m_panel = Curve([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])
filtered_curve = Curve(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)
activate = BooleanToggle(False)
export_2 = BooleanToggle(False)
run = BooleanToggle(True)
intcrv = Interpolate(Vertices=pt_8, Degree=3, Periodic=False, KnotStyle=1)  # -> Curve, Length, Domain
spray_path = Slider(0, range=0..10)
send_to_scan = Button()
number_of_iterations_for_each_spray_path = Panel("10")  # "Number of iterations for each spray path (for design visualization only)"
iteration = Slider(1, range=0..10)
data = Data(spray_path)
data_2 = Data(number_of_iterations_for_each_spray_path)
data_3 = Data(data_2)

# ----
# Load .ply
# To start the proxy server:
# - Start Ananconda Promt (as admin)
# - Run:
# from compas.rpc import Proxy
# p = Proxy()
type = ValueList({"mesh"}, selected="mesh")
start_proxy = BooleanToggle(False)
py_2 = GhPythonScript()  # -> ply_source
# ---------- py_2: Python ----------
import os
import sys

filepath = ghenv.Component.Attributes.Owner.OnPingDocument().FilePath
path = os.path.abspath(os.path.join(filepath, "..", "..", ".."))
print(path)

ply_source = os.path.abspath(os.path.join(path, "data/ply"))
# ---------- end py_2 ----------
panel_15 = Panel(py_2)
export_ply = GhPythonScript(activate=activate, start_proxy=start_proxy, export=export_2, path=panel_15, type=type)  # -> out
# ---------- export_ply: Python ----------
from compas_ghpython import unload_modules
unload_modules('robotic_plaster_spraying.depthscan')
from compas.rpc import Proxy
import os

filename = os.path.join(os.path.abspath(path), 'scan.ply')
print filename

if activate:
    if start_proxy:
        depthscan = Proxy('robotic_plaster_spraying.depthscan')
    else:
        Proxy.stop_server(depthscan)
    if export:
        if type == "mesh":
            filename = os.path.join(os.path.abspath(path), 'scan.ply')
            depthscan.export(filename, mesh=True, pc=False)
        if type == "pointcloud":
            filename = os.path.join(os.path.abspath(path), 'pc.ply')
            depthscan.export(filename, mesh=False, pc=True)
# ---------- end export_ply ----------
path = PythonScript(path=panel_15)  # -> data
# ---------- path: Python ----------
import os

data = os.path.join(os.path.abspath(path), 'scan.ply')
# ---------- end path ----------
import_scan = PythonScript(run=run, data=path)  # -> out, mesh
# ---------- import_scan: Python ----------
from compas.datastructures import Mesh
from compas_ghpython.artists import MeshArtist

if run:
    scanned_surface = Mesh.from_ply(data)
    artist = MeshArtist(scanned_surface)
    
    mesh = artist.draw()
# ---------- end import_scan ----------
process_mesh = Process_mesh(box=axis_setting.boundingbox, G=import_scan.mesh, pt="-280, 0, 350")
mesh_4 = Mesh(process_mesh)

# ----
# Curve
crv_5 = Curve(flatten(intcrv.Curve))

# ----
# Build Base Mesh
offset = Slider(125, range=0..200)
resolution = Slider(25, range=0..100)
build_2 = GhPythonScript(mesh=mesh_4, offset=offset, resolution=resolution)  # -> out, mesh; inputs mesh: Mesh, resolution: Int32
# ---------- build_2: Python ----------
import Rhino.Geometry as rg
from robotic_plaster_spraying.utilities_fabrication.projection import RhinoMeshData

if mesh:
    points, fIDs, average_normal = RhinoMeshData(mesh)
    x_vec = rg.Vector3d.CrossProduct(average_normal, rg.Vector3d.ZAxis)
    x_vec.Unitize()
    
    b_box = rg.BoundingBox(points)
    box = rg.Box(b_box)
    
    x_length = box.X[1]-box.X[0]
    y_length = box.Y[1]-box.Y[0]
    height = box.Z[1]-box.Z[0]
    
    if x_length - y_length> 0:
        width = x_length
    else:
        width = y_length
    
    pt = box.Center - (width-offset)/2*x_vec - (height-offset)/2*rg.Vector3d.ZAxis
    plane = rg.Plane(pt, x_vec, rg.Vector3d.ZAxis)
    
    interval = rg.Interval(0,resolution+1)
    
    mesh = rg.Mesh.CreateFromPlane(plane, rg.Interval(0,width-offset), rg.Interval(0,height-offset), int(width/resolution), int(height/resolution))
# ---------- end build_2 ----------
mesh_5 = Mesh(build_2.mesh)

send_path = Button()
data_4 = Data("0")

# ----
# Project Path on Mesh to Adapt
crv_6 = Curve(flatten(crv_5))
crv_7 = Curve(crv_4)
pt_9 = Point(Point(0, 0, 0))
curve_direction = GhPythonScript(curves=crv_6, edited_curves=crv_7, robot_position=pt_9)  # -> out, curves, edited_curves, tangent, normal; inputs curves: list of Curve, edited_curves: list of Curve, robot_position: Point3d
# ---------- curve_direction: Python ----------
import Rhino.Geometry as rg

def check_curve_direction(curves, robot_position):
    r_curves = []
    for curve in curves:
        vec1 = rg.Vector3d(robot_position-curve.PointAtStart)
        vec2 = rg.Vector3d(robot_position-curve.PointAtEnd)
        cross_product = rg.Vector3d.CrossProduct(vec1,vec2)
        
        if cross_product.Z>0:
            curve.Reverse()
            r_curves.append(curve)
        else:
            r_curves.append(curve)
    return r_curves

curves = check_curve_direction(curves, robot_position)
edited_curves = check_curve_direction(edited_curves, robot_position)

vec = rg.Vector3d(curves[0].PointAtStart-curves[0].PointAtEnd)
normal=rg.Vector3d.CrossProduct(vec,rg.Vector3d(0,0,-1))
tangent=rg.Vector3d.CrossProduct(normal,rg.Vector3d(0,0,1))
# ---------- end curve_direction ----------
crv_8 = Curve(curve_direction.curves)
crv_9 = Curve(crv_8)

# ----
# Read JSON_0
toggle = BooleanToggle(False)

# ----
# Bound of Velocity
panel_16 = Panel("0.05")
dom_3 = ConstructDomain(DomainStart=panel_16, DomainEnd="1.0")

# ----
# Constant Values
velocity_constant = Slider(0.8, range=0.1..1.1)
ed_constant = Slider(500, range=0..500)

value_list = ValueList({"No Scan": 0, "Layer 0": 1, "Read base mesh from json": 2}, selected="No Scan")
filter = StreamFilter(Gate=value_list, Stream0=scale.Geometry, Stream1=mesh_4, Stream2=mesh_4)
scanned_mesh = Mesh(filter)

list_4 = ValueList({"Constant Velocity": 0, "Linear Acceleration": 1, "Sinusoidal Acceleration": 2, "Custom Acceleration": 3, "Enhanced Velocity": 4, "Acceleration from Hand Gesture": 5, "From Json": 6}, selected="From Json")
list_5 = ValueList({"Constant Ed": 0, "Linear Ed": 1, "Sinusoidal Ed": 2, "Custom Ed": 3, "Enhaced Ed": 4, "Ed from Hand Gesture": 5, "From Json": 6}, selected="From Json")

# ----
# Project Base Mesh Vertices onto Scanned Mesh
mesh_6 = Mesh(scanned_mesh)

# ----
# Generate Target Planes
number_slider_4 = Slider(0, range=-15..0)

py_3 = GhPythonScript()  # -> urdf_source
# ---------- py_3: Python ----------
import os
import sys

filepath = ghenv.Component.Attributes.Owner.OnPingDocument().FilePath
path = os.path.abspath(os.path.join(filepath, "..", ".."))
print(path)

urdf_source = os.path.abspath(os.path.join(path, "robot_description"))
# ---------- end py_3 ----------
panel_17 = Panel(py_3)
robot_name = ValueList({"ur10_2m"}, selected="ur10_2m")
disconnect_2 = Button()
connect_3 = Button()
restart_2 = Button()
list_6 = ValueList({"simulation": 0, "real_robot": 1}, selected="simulation")
path_2 = PythonScript(path=panel_17, robot_name=robot_name)  # -> urdf_source
# ---------- path_2: Python ----------
import os

urdf_source = os.path.join(os.path.abspath(path), robot_name)

assert(os.path.isdir(urdf_source))
# ---------- end path_2 ----------
ros_2 = PythonScript(restart=restart_2, ip=list_6)  # -> ros_client
# ---------- ros_2: Python ----------
import time
import logging
import scriptcontext as sc

from compas_fab.backends import RosClient
from System import TimeSpan
from System.Threading import ManualResetEventSlim


LOGGER = logging.getLogger('roslibpy')

guid = str(ghenv.Component.InstanceGuid)
ros_client_key = "rosclient_" + guid

previous_client = sc.sticky.get(ros_client_key, None)
if previous_client:
    previous_client.terminate()

if ip == 0: #local
    ros_client = RosClient('127.0.0.1', 9090) #local, own laptop
elif ip == 1: #real robot
    ros_client = RosClient('127.0.0.1', 9090) #place holder

waitLock = ManualResetEventSlim(False)
ros_client.on_ready(lambda: waitLock.Set())

if not waitLock.Wait(TimeSpan.FromSeconds(5)):
    raise Exception('Unable to connect to ROS')

LOGGER.info('Connected to ROS')
# ---------- end ros_2 ----------
connect_4 = PythonScript(ros_client=ros_2, connect=connect_3, disconnect=disconnect_2)  # -> out, ros_client
# ---------- connect_4: Python ----------
import logging
from System import TimeSpan
from System.Threading import ManualResetEventSlim

LOGGER = logging.getLogger('roslibpy')

if connect:
    if not ros_client.is_connected:
        LOGGER.debug('Connecting...')
        waitLock = ManualResetEventSlim(False)
        ros_client.on_ready(lambda: waitLock.Set())
        ros_client.connect()

        if not waitLock.Wait(TimeSpan.FromSeconds(5)):
            raise Exception('Unable to connect to ROS')
        LOGGER.debug('Reconnected')

if disconnect:
    if ros_client.is_connected:
        ros_client.terminate()
        LOGGER.debug('Terminated')
# ---------- end connect_4 ----------
units = ValueList({"m": 1, "mm": 1000}, selected="mm")
load = BooleanToggle(False)
robot = PythonScript(urdf_source=path_2, ros_client=connect_4.ros_client, scale_factor=units, load=load)  # -> out, robot
# ---------- robot: Python ----------
import os
from scriptcontext import sticky as st
import compas


from compas.robots import RobotModel
from compas.robots import LocalPackageMeshLoader
from compas_fab.ghpython import RobotArtist
from compas_fab.robots import RobotSemantics as RobotSemantics

from compas_fab.robots import Robot as Robot
from compas_fab.backends import RosClient

# Set high precision to import meshes defined in meters
compas.PRECISION = '12f'

# store data in component
guid = str(ghenv.Component.InstanceGuid)
robot_key = "robot_" + guid


if robot_key not in st:
    st[robot_key] = None


if ros_client and ros_client.is_connected and load == True:
    
    model = RobotModel.from_urdf_file(os.path.join(urdf_source, 'robot_description.urdf'))
    model.load_geometry(LocalPackageMeshLoader(urdf_source, 'robot_description'))
    semantics = RobotSemantics.from_srdf_file(os.path.join(urdf_source, 'robot_description.srdf'), model)
    artist = RobotArtist(model)
    robot = Robot(model, artist, semantics)
    
    robot.scale(scale_factor)
    st[robot_key] = robot

robot = st[robot_key]

if robot:
    robot.client = ros_client
# ---------- end robot ----------
info = PythonScript(robot=robot.robot)  # -> out, main_group_name
# ---------- info: Python ----------
if robot:
    robot.info()
    main_group_name = robot.main_group_name
# ---------- end info ----------
panel_18 = Panel(info.out)
main_planning_group = Text(info.main_group_name)
show = ValueList({"scan_pose": 0, "safe_pose": 1, "slider": 2}, selected="safe_pose")
state = ValueList({"forward_kinematics": 0, "plan_cartesian_motion": 1}, selected="plan_cartesian_motion")
show_end_effector_frame = BooleanToggle(True)
show_visual = BooleanToggle(True)
show_axes = BooleanToggle(False)

# ----
# Configuration
j1 = Slider(-10, range=-360..360)
j2 = Slider(-105, range=-360..360)
j3 = Slider(165, range=-360..360)
j4 = Slider(120, range=-360..360)
j5 = Slider(-80, range=-360..360)
j6 = Slider(0, range=-360..360)
forward_kinematics = PythonScript(robot=robot.robot, group=main_planning_group, show=show, j1=j1, j2=j2, j3=j3, j4=j4, j5=j5, j6=j6)  # -> configuration
# ---------- forward_kinematics: Python ----------
import math
from compas_fab.robots import Configuration

if robot:
    if show == 0:
        joint_positions = [-10 + math.degrees(3.14159), -105, 165, 120, -80, 0]
    if show == 1:
        joint_positions = [35 + math.degrees(3.14159), -35, 125, 90, -90, 0]
    if show == 2:
        joint_positions = [j1 + math.degrees(3.14159), j2, j3, j4, j5, j6]
    joint_positions = [math.radians(a) for a in joint_positions]
    types = robot.get_configurable_joint_types(group)
    configuration = Configuration(joint_positions, types)
    print configuration
# ---------- end forward_kinematics ----------

data_5 = Data(data_4)
data_6 = Data(data_5)

# ----
# Data Gathering
# Generate JSON
panel_19 = Panel("210128_2m_Panel")
py_4 = GhPythonScript()  # -> json_source; same code as py
generate_fabrication_parameters_json = Button()
generate_mesh_json = Button()

panel_20 = Panel(py_4)

read_2 = GhPythonScript(path=panel_20, name_json=panel_19, generate_Mesh=toggle)  # -> out, mesh; inputs generate_Mesh: Boolean
# ---------- read_2: Python ----------
import os
import json
from compas.datastructures import Mesh
from compas_ghpython.artists import MeshArtist


if generate_Mesh:
    layer_number = 0
    filename = os.path.join(path, name_json+'_Base_Mesh_%d.json' % layer_number)
    print filename
    c_mesh = Mesh.from_json(filename)
    
    artist = MeshArtist(c_mesh)
    mesh = artist.draw()
# ---------- end read_2 ----------
dam = DataDam(DataA=read_2.mesh, BufferDelay=10000000, BufferMode=0)
clean_2 = CombineClean(Meshes=dam)

filter_2 = StreamFilter(Gate=value_list, Stream0=clean, Stream1=mesh_5, Stream2=clean_2)
base_mesh = Mesh(filter_2)

mesh_7 = Mesh(base_mesh)
projection = GhPythonScript(base_mesh=mesh_7, scanned_mesh=mesh_6, normal=curve_direction.normal)  # -> out, transformed_mesh, projected_direction; inputs base_mesh: Mesh, scanned_mesh: Mesh, normal: Vector3d
# ---------- projection: Python ----------
import Rhino.Geometry as rg
import Rhino as rc
import math as m
from robotic_plaster_spraying.utilities_fabrication import projection
reload(projection)
from robotic_plaster_spraying.utilities_fabrication.data_gathering import remapValues

def mapValueListAsColor(values):
    
    """ Make a list of HSL color where the values are mapped onto a 
    0.0 - 0.7 hue domain. Meaning that low values will be red, medium
    values green and large values blue """
    
    colors = []
    remappedValues = remapValues(values,0.0,0.7)
    for v in remappedValues:
        c = rc.Display.ColorHSL(v,1.0,0.5).ToArgbColor()
        #c = rc.Display.ColorXYZ(v,0,0)
        colors.append(c)
    
    return colors

def colorMesh(mesh,colors):
    """ Color mesh vertices by a list of colors """
    for i,c in enumerate(colors):
        mesh.VertexColors.SetColor(i,c)

points, fIDs, projected_direction = projection.RhinoMeshData(base_mesh)

angle = rg.Vector3d.VectorAngle(projected_direction,normal)
if angle>m.radians(100):
    print ("reverse")
    projected_direction.Reverse()

transformed_vertices = projection.PointProjectOnMesh(points, scanned_mesh, projected_direction)

transformed_mesh = rg.Mesh()

distances = []
for i in range(len(transformed_vertices)):
    transformed_mesh.Vertices.Add(transformed_vertices[i])
    distances.append(transformed_vertices[i].DistanceTo(points[i]))

[transformed_mesh.Faces.AddFace(*fID) for fID in fIDs]

colors = mapValueListAsColor(distances)
colorMesh(transformed_mesh,colors)
transformed_mesh.Smooth(1, True, True, True, True, 0)
# ---------- end projection ----------
mesh_8 = Mesh(projection.transformed_mesh)
vec = Vector(projection.projected_direction)

project_direction = Data(vec)
project = GhPythonScript(curves=crv_9, transformed_mesh=mesh_8, project_direction=project_direction, divide_length="25")  # -> out, target_points; inputs curves: list of Curve, transformed_mesh: Mesh
# ---------- project: Python ----------
from robotic_plaster_spraying.utilities_fabrication import projection
reload(projection)
import Rhino.Geometry as rg
import ghpythonlib.treehelpers as th

target_points = []
for curve in curves:
    p_IDs = curve.DivideByLength(divide_length,True)
    pts = [curve.PointAt(p_IDs[i]) for i in range(len(p_IDs))]
    p_pts = projection.PointProjectOnMesh(pts, transformed_mesh, project_direction, allow_to_skip = True)
    target_points.append(p_pts)

target_points = th.list_to_tree(target_points)
# ---------- end project ----------
pt_10 = Point(project.target_points)

pt_11 = Point(pt_10)

# ----
# Linear
lng = ListLength(List=pt_11)
range = Range(Domain=Domain(0, 1), Steps=expr("x-1", lng))
graph = GraphMapper(
    range,
    x0=1,
    x1=0,
    y0=1,
    y1=0,
    A=1,
    B=0,
    container_name="Linear",
    Graph_x0=0.25,
    Graph_x1=0.75,
    Graph_y0=0.25,
    Graph_y1=0.75)
remap = RemapNumbers(Value=graph, Source=Domain(0, 1), Target=dom_2)  # -> Mapped, Clipped
remap_2 = RemapNumbers(Value=graph, Source=Domain(0, 1), Target=dom_3)  # -> Mapped, Clipped

# ----
# Sinusoidal
lng_2 = ListLength(List=pt_11)
range_2 = Range(Domain=Domain(0, 1), Steps=expr("x-1", lng_2))
graph_2 = GraphMapper(range_2, x0=0, x1=1, y0=0, y1=1, container_name="Sine", Equation_px=[0, 0.5012611151], Equation_py=[1, 0])
remap_3 = RemapNumbers(Value=graph_2, Source=Domain(0, 1), Target=dom_3)  # -> Mapped, Clipped
remap_4 = RemapNumbers(Value=graph_2, Source=Domain(0, 1), Target=dom_2)  # -> Mapped, Clipped

# ----
# Acceleration and Ed from Hand Gesture
python_4 = GhPythonScript(curves=crv_8, target_points=pt_10, velocity_bound=dom_3, Ed_bound=dom_2)  # -> out, velocity_values_out, Ed_values_out, polyline_pt; inputs curves: list of Curve, target_points: tree of Point3d
# ---------- python_4: Python ----------
import ghpythonlib.treehelpers as th
import Rhino.Geometry as rg
from compas.geometry import Polyline
from compas.geometry import is_point_on_line
from robotic_plaster_spraying.utilities_fabrication.data_gathering import remapValues

target_points_list = [list(b) for b in target_points.Branches]

v_min, v_max = velocity_bound
Ed_min, Ed_max = Ed_bound

polylines = []

for i,curve in enumerate(curves):
    segment = list(curve.DuplicateSegments())
    pts = []
    for j,line in enumerate(segment):
        if j == len(segment)-1:
            pt_s = [line.PointAtStart.X, line.PointAtStart.Y, line.PointAtStart.Z] 
            pt_e = [line.PointAtEnd.X, line.PointAtEnd.Y, line.PointAtEnd.Z]
            pts.append(pt_s)
            pts.append(pt_e)
        else:
            pt_s = [line.PointAtStart.X, line.PointAtStart.Y, line.PointAtStart.Z] 
            pts.append(pt_s)
    
    polylines.append(Polyline(pts))

velocity_values_list = []
Ed_values_list = []
polyline_pt = []

for polyline, points in zip(polylines, target_points_list):

    count = len(points)
    t = 1/count
    velocity_values = []
    Ed_values = []

    # Find on which segment that the target points are located and asign segment's length (velocity)
    for j in range(count):
        t_pt = [points[j].X, points[j].Y, points[j].Z]
        
        pt = polyline.point(t*j)
        
        distance = t_pt[0] - pt[0]
        Ed_values.append(distance)
        polyline_pt.append(rg.Point3d(pt[0],pt[1],pt[2]))
        
        for line in polyline.lines:
            if is_point_on_line(pt, line) == True:
                length = line.length
                velocity_values.append(length)
                break

    velocity_values = remapValues(velocity_values, v_max, v_min)
    Ed_values = remapValues(Ed_values, Ed_min, Ed_max)

    velocity_values_list.append(velocity_values)
    Ed_values_list.append(Ed_values)


#print velocity_values_list
velocity_values_out = th.list_to_tree(velocity_values_list)
Ed_values_out = th.list_to_tree(Ed_values_list)
# ---------- end python_4 ----------
tag = TextTag(Location=pt_10, Text=python_4.velocity_values_out)

# ----
# Custom Acceleration and Ed
python_5 = GhPythonScript(curves=crv_8, edited_curves=curve_direction.edited_curves, target_points=pt_10, velocity_bound=dom_3, Ed_bound=dom_2)  # -> out, velocity_values_out, Ed_values_out; inputs curves: list of Curve, edited_curves: list of Curve, target_points: tree
# ---------- python_5: Python ----------
import Rhino.Geometry as rg
import ghpythonlib.treehelpers as th
from compas.geometry import Polyline
from compas.geometry import distance_point_point
from robotic_plaster_spraying.design import fabrication_parameter_effects
reload(fabrication_parameter_effects)

target_points_list = [list(b) for b in target_points.Branches]

v_min, v_max = velocity_bound
Ed_min, Ed_max = Ed_bound

polylines = []
e_polylines = []

for target_points, curve, edited_curve in zip(target_points_list, curves, edited_curves):
    
    count = len(target_points)-1
    p_IDs = curve.DivideByCount(count,True)
    e_p_IDs = edited_curve.DivideByCount(count,True)
    
    pts = []
    e_pts = []
    for p_ID, e_p_ID in zip(p_IDs, e_p_IDs):
        pt = curve.PointAt(p_ID)
        e_pt = edited_curve.PointAt(e_p_ID)
        pts.append(pt)
        e_pts.append(e_pt)
    
    polyline = Polyline(pts)
    e_polyline = Polyline(e_pts)
    
    polylines.append(polyline)
    e_polylines.append(e_polyline)

velocity_values_list, Ed_values_list = fabrication_parameter_effects.Custom_Acceleration_and_Ed(polylines, e_polylines, v_min, v_max, Ed_min, Ed_max)

#print velocity_values_list
velocity_values_out = th.list_to_tree(velocity_values_list)
Ed_values_out = th.list_to_tree(Ed_values_list)
# ---------- end python_5 ----------

# ----
# User Input for Enhancing Effect
python_6 = GhPythonScript(target_points=pt_10, velocity_bound=dom_3, Ed_bound=dom_2)  # -> out, velocity_tree, Ed_tree; inputs target_points: tree of Point3d
# ---------- python_6: Python ----------
import ghpythonlib.treehelpers as th
from compas.geometry import Point
from robotic_plaster_spraying.design import UserInputforEnhancingEffect

if target_points.BranchCount > 1:
    
    v_min, v_max = velocity_bound
    Ed_min, Ed_max = Ed_bound
    
    target_points = [list(b) for b in target_points.Branches]
    
    c_pts_list = []
    for points in target_points:
        c_pts = []
        for pt in points:
            c_pts.append(Point(pt.X, pt.Y, pt.Z))
        c_pts_list.append(c_pts)
    
    velocity_list, Ed_list = UserInputforEnhancingEffect(c_pts_list, v_max, v_min, Ed_max, Ed_min)
    
    velocity_tree = th.list_to_tree(velocity_list)
    Ed_tree = th.list_to_tree(Ed_list)
# ---------- end python_6 ----------

expression = Expression(x=pt_11, y=ed_constant, Expression="y")
expression_2 = Expression(x=pt_11, y=velocity_constant, Expression="y")

filter_3 = StreamFilter(
    Gate=list_4,
    Stream0=expression_2,
    Stream1=remap_2.Mapped,
    Stream2=remap_3.Mapped,
    Stream3=python_5.velocity_values_out,
    Stream4=python_6.velocity_tree,
    Stream5=python_4.velocity_values_out,
    Stream6=read.velocity_list_out)
filter_4 = StreamFilter(
    Gate=list_5,
    Stream0=expression,
    Stream1=remap.Mapped,
    Stream2=remap_4.Mapped,
    Stream3=python_5.Ed_values_out,
    Stream4=python_6.Ed_tree,
    Stream5=python_4.Ed_values_out,
    Stream6=read.Ed_list_out)
target_points = Point(pt_10)
ed = Data(filter_4)
velocity = Data(filter_3)

tstat = TreeStatistics(Tree=ed)  # -> Paths, Length, Count
repeat = RepeatData(Data=number_slider_4, Length=tstat.Length)

python_7 = GhPythonScript(target_points=target_points, project_direction=project_direction, Ed=ed, angle=repeat)  # -> out, target_frames; inputs target_points: tree of Point3d, Ed: tree, angle: tree
# ---------- python_7: Python ----------
import math
import Rhino.Geometry as rg
import ghpythonlib.treehelpers as th
from compas.geometry import Point, Vector, Polyline, Frame
from compas.geometry import cross_vectors
from compas.geometry import Rotation
from compas_ghpython import draw_frame
from compas.geometry import Translation, Vector


project_direction = Vector(project_direction.X, project_direction.Y, project_direction.Z)
project_direction.unitize()
n_z_vec = Vector(0,0,-1)
p_z_vec = Vector(0,0,1)


target_points_list = [list(b) for b in target_points.Branches]
Ed_list = [list(b) for b in Ed.Branches]
angle_list = [list(b) for b in angle.Branches]

c_target_points = []
for target_points in target_points_list:
    if len(target_points) == 1:
        c_target_points.append(Point(target_points.X, target_points.Y, target_points.Z))
    else:
        temp_points = []
        for pt in target_points:
            temp_points.append(Point(pt.X, pt.Y, pt.Z))
        c_target_points.append(temp_points)

# Normal Averaged From Base Mesh
target_frames = []

for pts, Eds, angles in zip(c_target_points, Ed_list, angle_list):
    temp_list = []
    for pt, Ed, angle in zip(pts, Eds, angles):
        # Ed
        pt = pt + project_direction * Ed
        
        xAxis = cross_vectors(project_direction,n_z_vec)
        frame = Frame(pt, xAxis, n_z_vec)
        
        #Rotation
        angle = math.radians(angle)
        R = Rotation.from_axis_and_angle(frame.yaxis, angle, frame.point)
        #R = Rotation.from_axis_and_angle(frame.xaxis, angle, frame.point)
        frame.transform(R)
        
        temp_list.append(frame)
    target_frames.append(temp_list)
# ---------- end python_7 ----------
python_8 = GhPythonScript(target_frames=python_7.target_frames)  # -> out, target_planes; inputs target_frames: list
# ---------- python_8: Python ----------
import Rhino.Geometry as rg
import ghpythonlib.treehelpers as th

target_planes = []
for frames in target_frames:
    temp_list = []
    for frame in frames:
        plane = rg.Plane(rg.Point3d(frame.point.x, frame.point.y, frame.point.z), 
                         rg.Vector3d(frame.xaxis.x, frame.xaxis.y, frame.xaxis.z),
                         rg.Vector3d(frame.yaxis.x, frame.yaxis.y, frame.yaxis.z))
        temp_list.append(plane)
    target_planes.append(temp_list)

target_planes = th.list_to_tree(target_planes)
# ---------- end python_8 ----------
pln_5 = Plane(python_8.target_planes)

mesh_9 = Mesh(mesh_8)
vec_2 = Vector(vec)
pln_6 = Plane(pln_5)
data_7 = Data(velocity)
data_8 = Data(ed)
mesh_10 = Mesh(base_mesh)
pln_7 = Plane(simplify(pln_6))
pt_12 = Point(simplify(pln_6))
data_9 = Data(data_7)
data_10 = Data(data_8)
mesh_11 = Mesh(mesh_10)
vec_3 = Vector(vec_2)
mesh_12 = Mesh(mesh_9)

# ----
# Robot Control
python_9 = GhPythonScript(target_planes=pln_7, velocity=data_9, branch=data)  # -> out, simplify(target_planes_out), simplify(velocity_out); inputs target_planes: tree, velocity: tree, branch: Int32
# ---------- python_9: Python ----------
print target_planes.BranchCount
if target_planes.BranchCount > 1:
    target_planes_list = [list(b) for b in target_planes.Branches]
    velocity_list = [list(b) for b in velocity.Branches]
    
    target_planes_out = target_planes_list[branch]
    velocity_out = velocity_list[branch]
else:
    target_planes_out = target_planes
    velocity_out = velocity
# ---------- end python_9 ----------
reverse = BooleanToggle(True)
run_2 = BooleanToggle(True)
robotic_fabrication = GhPythonScript(
    run=run_2,
    target_planes=python_9.target_planes_out,
    velocity=python_9.velocity_out,
    iteration=iteration,
    reverse_list=reverse,
    send=send_path,
    send_to_scan=send_to_scan)  # -> f_planes; inputs target_planes: tree of Plane, velocity: tree, iteration: Int32, reverse_list: Boolean, send_to_scan: Boolean
# ---------- robotic_fabrication: Python ----------
################################################################################
############# IMPORTS ##########################################################
################################################################################
###     Future imports          ###
from __future__ import division, absolute_import, print_function
###     Standard lib imports    ###
import math as m
###     Rhino lib imports       ###
import Rhino.Geometry as rg
import scriptcontext as sc
import ghpythonlib.treehelpers as t
###     UR Robot Library        ###
import comm
import ur_standard 
reload(comm)
reload(ur_standard)
################################################################################
############# FUNCTIONS ########################################################
################################################################################
if run:
    def popup(text):
        cmd = "\tpopup(\"{}\")\n".format(text)
        return cmd
    ################################################################################
    #############      #############################################################
    ############# MAIN #############################################################
    #############      #############################################################
    ################################################################################
    ### Create "global" variables   ###
    debug = []
    viz_planes = []
    ### Create a script object      ###
    script  = ""
    s_script  = ""
    f_script = ""
    ### Robot inital values         ###
    robot_speed = 0.2  # m/s
    robot_accel = 0.2   # m/s2
    blend_rad = 0.02   # m
    ACTUATOR_IO = 1
    scan_time = 60     #s
    spray_sleep = 0.45    #s
    translation_vector = sc.sticky["translation_vector_key"]
    ### Tool related variables      ###
    #TOOL_HEIGHT = 0   #mm
    ### Process related variables   ###
    ACTUATOR_IO = 1
    squeeze_valve_IO = 0
    air_pressure_IO = 1
    forward_pumping_IO = 6
    backward_pumping_IO = 7
    pump_speed = 0.3
    ################################################################################
    ### Define the TCP              ###

    print(translation_vector)
    set_tcp = ur_standard.set_tcp_by_angles(translation_vector[0], 0, translation_vector[2], 
                                            0.0, 0.0, 0.0)
    script += set_tcp
    
    script += ur_standard.set_digital_out(squeeze_valve_IO, True)
    script += ur_standard.set_digital_out(air_pressure_IO, False)
    script += ur_standard.set_digital_out(forward_pumping_IO, False)
    script += ur_standard.set_analog_out(1, pump_speed)
    
    pos = [ m.radians(35), 
            m.radians(-35), 
            m.radians(125), 
            m.radians(90), 
            m.radians(-90),
            m.radians(0)]
    script += ur_standard.move_j(pos, 0.1, 0.5)
    
    s_pos = [ m.radians(-10),
        m.radians(-105),
        m.radians(165),
        m.radians(120),
        m.radians(-80),
        m.radians(0)]
        
    ### Sent to scan ###
    
    s_script += ur_standard.move_j(pos, 0.1, 0.5)
    s_script += ur_standard.move_j(s_pos, 0.1, 0.5)
    
    ### Sort plane ###
    
    target_planes_list = [list(b) for b in target_planes.Branches]
    velocity_list = [list(b) for b in velocity.Branches]
    
    f_planes = []
    f_speeds = []
    start_IDs = []
    stop_IDs = []
    stop_air_pump_IDs = []
    
    for i in range(iteration):
        for target_planes_b, velocity_b in zip(target_planes_list, velocity_list):
            if reverse_list:
                if i > 0:
                    #print(i,"reverse")
                    target_planes_b.reverse()
                    velocity_b.reverse()
            
            for j in range(len(target_planes_b)):
                if j == 0:
                    f_planes.extend([target_planes_b[j],target_planes_b[j]])
                    f_speeds.extend([velocity_b[j],velocity_b[j]])
                    start_IDs.append(len(f_planes)-1)
                elif j == len(target_planes_b)-1:
                    f_planes.extend([target_planes_b[j],target_planes_b[j]])
                    f_speeds.extend([velocity_b[j],velocity_b[j]])
                    stop_IDs.append(len(f_planes)-1)
                else:
                    f_planes.append(target_planes_b[j])
                    f_speeds.append(velocity_b[j])
    
    ### Start Robotic Spraying Fabrication process ###
    
    for i in range(len(f_planes)):
        
        speed = f_speeds[i]
        # Robot_accel = speed/2
        script += ur_standard.move_l(f_planes[i], speed/2, speed ,blend_radius = blend_rad)
        # Control IO
        if i in start_IDs:
            script += ur_standard.set_digital_out(squeeze_valve_IO, False)
            script += ur_standard.set_digital_out(forward_pumping_IO, True)
            script += ur_standard.set_digital_out(air_pressure_IO, True)
        elif i in stop_air_pump_IDs:
            script += ur_standard.set_digital_out(forward_pumping_IO, False)
            script += ur_standard.set_digital_out(air_pressure_IO, False)
        elif i in stop_IDs[:-1]:
            if not reverse_list:
                #print("False")
                script += ur_standard.set_digital_out(forward_pumping_IO, False)
                script += ur_standard.set_digital_out(squeeze_valve_IO, True)
                script += ur_standard.sleep(spray_sleep)
                script += ur_standard.set_digital_out(air_pressure_IO, False)
        elif i == stop_IDs[-1]:
            script += ur_standard.set_digital_out(forward_pumping_IO, False)
            script += ur_standard.set_digital_out(squeeze_valve_IO, True)
            script += ur_standard.sleep(spray_sleep)
            script += ur_standard.set_digital_out(air_pressure_IO, False)
            script += ur_standard.move_j(pos, 0.1, 0.5)
            script += ur_standard.move_j(s_pos, 0.1, 0.5)
            script += ur_standard.sleep(scan_time)
    
    script += ur_standard.set_analog_out(1, 0.0)
    script += ur_standard.move_j(pos, 0.1, 0.5)
    
    ################################################################################
    ### Concatenate script ###
    script = comm.concatenate_script(script) 
    s_script = comm.concatenate_script(s_script)
    ### Send to the robot ###
    if send:
        comm.send_script(script, 1)
    if send_to_scan:
        script += ur_standard.set_digital_out(air_pressure_IO, False)
        script += ur_standard.set_digital_out(forward_pumping_IO, False)
        comm.send_script(s_script, 1)
# ---------- end robotic_fabrication ----------
pln_8 = Plane(robotic_fabrication)

# ----
# Design Visualization
# Linear Model
toggle_2 = BooleanToggle(False)
dam_2 = DataDam(DataF=mesh_11, DataA=pt_12, DataB=data_9, DataC=data_10, DataD=data_3, DataE=vec_3, BufferDelay=10000000, BufferMode=0)  # -> DataF, DataA, DataB, DataC, DataD, DataE
toggle_3 = BooleanToggle(True)
mesh_13 = Mesh(dam_2.DataF)
pt_13 = Point(dam_2.DataA)
vel = Data(dam_2.DataB)
linear_model = GhPythonScript(
    base_mesh=mesh_13,
    target_points=pt_13,
    velocity=vel,
    Ed=dam_2.DataC,
    layer_number=dam_2.DataD,
    project_direction=dam_2.DataE,
    run=toggle_2,
    color=toggle_3)  # -> out, simulate_Mesh, thickness; inputs base_mesh: Mesh, target_points: tree of Point3d, velocity: tree, Ed: tree, layer_number: list of Int32, project_direction: Vector3d, run: Boolean, color: Boolean
# ---------- linear_model: Python ----------
import Rhino as rc
from robotic_plaster_spraying.utilities_fabrication import linear_model

reload(linear_model)

from compas_ghpython.artists import MeshArtist

def remapValues(values, targetMin, targetMax):
    
    """ Remap numbers into a numeric domain """
    
    if len(set(values)) >1:
        
        remappedValues = []
        
        # Get source domain min and max
        scrMin = min(values)
        scrMax = max(values)
        
        # Iterate through the values and remap them
        for v in values:
            rv = ((v-scrMin)/(scrMax-scrMin))*(targetMax-targetMin)+targetMin
            remappedValues.append(rv)
        
        return remappedValues
    
    # Else return targetMax for each value
    else:
        return [targetMax]*len(values)


def mapValueListAsColor(values):
    """ Make a list of HSL color where the values are mapped onto a 
    0.0 - 0.7 hue domain. Low values will be red, medium
    values will be green and large values will be blue """
    
    colors = []
    remappedValues = remapValues(values,0.0,0.7)
    for v in remappedValues:
        c = rc.Display.ColorHSL(v,1.0,0.5).ToArgbColor()
        colors.append(c)
    return colors


def colorMesh(mesh,colors):
    """ Color mesh vertices by list of colors """
    for i,c in enumerate(colors):
        mesh.VertexColors.SetColor(i,c)

if run:
    simulate_Mesh, thickness = linear_model.visualize(base_mesh, target_points, velocity, Ed, layer_number, project_direction, plastering=True, grinding=False, m_scale=False, mm_scale=True)
    artist = MeshArtist(simulate_Mesh)
    simulate_Mesh = artist.draw()
    
    if color:
        thickness_to_color = mapValueListAsColor(thickness)
        colorMesh(simulate_Mesh,thickness_to_color)
# ---------- end linear_model ----------
mesh_14 = Mesh(linear_model.simulate_Mesh)
toggle_4 = BooleanToggle(False)
python_10 = GhPythonScript(data=simplify(graft(linear_model.thickness)), run=toggle_4, reset=Button())  # -> out, data; inputs data: tree
# ---------- python_10: Python ----------
from Grasshopper import DataTree

if reset or 'rec' not in globals(): rec = DataTree[object]()
if run and not reset: rec.MergeTree(data)

data = rec
# ---------- end python_10 ----------
python_11 = GhPythonScript(base_mesh=mesh_13, thickness=python_10.data, project_direction=dam_2.DataE, run=toggle_4, color=toggle_3)  # -> out, simulate_Mesh; inputs base_mesh: Mesh, thickness: tree, project_direction: Vector3d, run: Boolean, color: Boolean
# ---------- python_11: Python ----------
import Rhino.Geometry as rg
import Rhino as rc

def remapValues(values, targetMin, targetMax):
    
    """ Remap numbers into a numeric domain """
    
    if len(set(values)) >1:
        
        remappedValues = []
        
        # Get source domain min and max
        scrMin = min(values)
        scrMax = max(values)
        
        # Iterate through the values and remap them
        for v in values:
            rv = ((v-scrMin)/(scrMax-scrMin))*(targetMax-targetMin)+targetMin
            remappedValues.append(rv)
        
        return remappedValues
    
    # Else return targetMax for each value
    else:
        return [targetMax]*len(values)


def mapValueListAsColor(values):
    """ Make a list of HSL color where the values are mapped onto a 
    0.0 - 0.7 hue domain. Low values will be red, medium
    values will be green and large values will be blue """
    
    colors = []
    remappedValues = remapValues(values,0.0,0.7)
    for v in remappedValues:
        c = rc.Display.ColorHSL(v,1.0,0.5).ToArgbColor()
        colors.append(c)
    return colors


def colorMesh(mesh,colors):
    """ Color mesh vertices by list of colors """
    for i,c in enumerate(colors):
        mesh.VertexColors.SetColor(i,c)

if run:
    thickness_list = [list(b) for b in thickness.Branches]
    
    thickness = []
    
    for t in thickness_list:
        thickness.append(sum(t))
    
    for i in range(base_mesh.Vertices.Count):
        pt = base_mesh.Vertices.Item[i]
        x = rg.Transform.Translation(project_direction*thickness[i])
        pt.Transform(x)
        base_mesh.Vertices.SetVertex(i, pt)
    
    simulate_Mesh = base_mesh
    
    if color:
        thickness_to_color = mapValueListAsColor(thickness)
        colorMesh(simulate_Mesh,thickness_to_color)
# ---------- end python_11 ----------
mesh_15 = Mesh(python_11.simulate_Mesh)

pln_9 = Plane(pln_7)
mesh_16 = Mesh(mesh_12)
velocity_2 = Data(data_9)
ed_2 = Data(data_10)
generate_json = GhPythonScript(
    transformed_mesh=mesh_16,
    target_points=pln_9,
    velocity=velocity_2,
    Ed=ed_2,
    custom_layer_num=data_3,
    iteration=iteration,
    branch=data,
    layer_number=data_6,
    file_path=panel_20,
    name_json=panel_19,
    generate_mesh_JSON=generate_mesh_json,
    generate_fabrication_parameters_JSON=generate_fabrication_parameters_json)  # -> out, mesh; inputs transformed_mesh: Mesh, target_points: tree of Plane, velocity: tree, Ed: tree, custom_layer_num: list of Int32, iteration: Int32, branch: Int32, layer_number: Int32, generate_mesh_JSON: Boolean, generate_fabrication_parameters_JSON: Boolean
# ---------- generate_json: Python ----------
import os
import json
import Rhino.Geometry as rg
from compas.datastructures import Mesh
from compas_ghpython.artists import MeshArtist
from compas_rhino.geometry import RhinoMesh
from robotic_plaster_spraying.utilities_fabrication.projection import RhinoToCompasMesh
from robotic_plaster_spraying.utilities_fabrication.data_gathering import WriteDictToJson

pump_speed = 0.3 
air_pressure = 3 #bar

plane_list = [list(b) for b in target_points.Branches]
velocity_list = [list(b) for b in velocity.Branches]
Ed_list = [list(b) for b in Ed.Branches]

fabrication_parameters = {}
for i in range(len(plane_list)):
    fabrication_parameters[i] = {} 
    for j in range(len(plane_list[i])):
        plane = plane_list[i][j]
        if i == 0 and j == 0:
            print i,j
            fabrication_parameters[i][j] = {'xyz': [plane.OriginX, plane.OriginY,plane.OriginZ],
                                            'normal': [plane.Normal.X, plane.Normal.Y, plane.Normal.Z],
                                            'velocity': velocity_list[i][j],
                                            'Ed': Ed_list[i][j],
                                            'pump_speed': pump_speed,
                                            'air_pressure': air_pressure,
                                            'custom_layer_num': custom_layer_num
                                           }
        else:
            fabrication_parameters[i][j] = {'xyz': [plane.OriginX, plane.OriginY,plane.OriginZ],
                                            'normal': [plane.Normal.X, plane.Normal.Y, plane.Normal.Z],
                                            'velocity': velocity_list[i][j],
                                            'Ed': Ed_list[i][j]
                                           }

if layer_number == 0:
    branch = 'base_mesh'

c_mesh = RhinoToCompasMesh(transformed_mesh)
c_mesh.vertex_attributes(0, ['iteration', 'branch'], [iteration, branch])

### Generate JSON ###
mesh_filename = os.path.join(file_path, name_json+'_Base_Mesh_%d.json' % layer_number)
parameters_filename = os.path.join(file_path, name_json+'_Fabrication_Parameters.json')


if generate_mesh_JSON:
    c_mesh.to_json(mesh_filename, pretty = True)

if generate_fabrication_parameters_JSON:
    WriteDictToJson(parameters_filename, fabrication_parameters)

### Rhino mesh ###
mesh = MeshArtist(c_mesh)
mesh = mesh.draw()
# ---------- end generate_json ----------
mesh_17 = Mesh(generate_json.mesh)

# ----
# Volume
toggle_5 = BooleanToggle(False)
volume_2 = GhPythonScript(mesh=mesh_15, run=toggle_5, reverse_bool=Toggle(True))  # -> out, close_mesh; inputs mesh: Mesh, run: Boolean, reverse_bool: Boolean
# ---------- volume_2: Python ----------
from robotic_plaster_spraying.utilities_fabrication import projection
reload(projection)
from compas_ghpython.artists import MeshArtist

if run:
    mesh = projection.RhinoToCompasMesh(mesh)
    close_mesh = projection.CapMesh(mesh, reverse = reverse_bool)
    
    ### Rhino mesh ###
    mesh = MeshArtist(close_mesh)
    close_mesh = mesh.draw()
# ---------- end volume_2 ----------
mesh_18 = Mesh(volume_2.close_mesh)
volume_3 = Volume(G=mesh_18)
volume_m3_2 = Panel(volume_3)

# ---- group: cartesian motion
# Plan Cartesian Motion
py_5 = PythonScript(robot=robot.robot)  # -> configuration
# ---------- py_5: Python ----------
from compas_fab.robots import Configuration

if robot:
    types = robot.get_configurable_joint_types()
    values = [0] * len(types)

    configuration = Configuration(values, types)
    print configuration
# ---------- end py_5 ----------
start_configuration = Data(forward_kinematics)
list_7 = ValueList({"0", "1"}, selected="0")
compute = BooleanToggle(True)
filter_5 = StreamFilter(Gate=list_7, Stream0=start_configuration, Stream1=py_5)
planes = Plane(python_9.target_planes_out)
plan_cartesian_motion = PythonScript(
    robot=robot.robot,
    group=main_planning_group,
    start_configuration=filter_5,
    planes=planes,
    iteration=iteration,
    reverse_list=reverse,
    max_step=10,
    compute=compute)  # -> out, robot, group, trajectory; inputs planes: list, iteration: Int32, reverse_list: Boolean
# ---------- plan_cartesian_motion: Python ----------
import logging
import scriptcontext as sc
from compas.geometry import Frame
from compas.geometry import Translation
import math
from compas_fab.robots import Configuration

guid = str(ghenv.Component.InstanceGuid)
response_key = "response_" + guid
translation_vector_key = "translation_vector" + guid
if response_key not in sc.sticky:
    sc.sticky[response_key] = None

if robot:
    if robot.client:
        if robot.client.is_connected:
            if start_configuration and compute:
                frames = []
                for i in range(iteration):
                    if reverse_list and i > 0:
                        planes.reverse()
                    for plane in planes:
                        frames.append(Frame(plane.Origin, plane.ZAxis, -plane.XAxis))
                    
                    joint_positions = [math.radians(a) for a in [0, 0, 0, 0, 0, 0]]
                    types = robot.get_configurable_joint_types(group)
                    configuration = Configuration(joint_positions, types)
                    frames_temp = robot.transformed_frames(configuration, group)
                    f1 = frames_temp[8]
                    f2 = frames_temp[9]
                    translation_vector = [f1[0][1] - f2[0][1], 0, f1[0][2] - f2[0][2]]
                    sc.sticky["translation_vector_key"] = translation_vector
                    x = Translation.from_vector(translation_vector)
                    for frame in frames:
                        frame.transform(x)
                
                options = {'max_step':float(max_step)}
                response = robot.plan_cartesian_motion(frames, start_configuration=start_configuration, group=group, options=options)
                sc.sticky[response_key] = response
        else:
            print("Robot is not connected")
            sc.sticky[response_key] = None

trajectory = sc.sticky[response_key]
# ---------- end plan_cartesian_motion ----------
vis = PythonScript(trajectory=plan_cartesian_motion.trajectory)  # -> P, V, A, time
# ---------- vis: Python ----------
from compas_ghpython import list_to_ghtree

if trajectory:

    positions = []
    velocities = []
    accelerations = []
    time_from_start = []

    for p in trajectory.points:
        positions.append(p.positions)
        velocities.append(p.velocities)
        accelerations.append(p.accelerations)
        time_from_start.append(p.time_from_start.seconds)

    P = list_to_ghtree(list(zip(*positions)))
    V = list_to_ghtree(list(zip(*velocities)))
    A = list_to_ghtree(list(zip(*accelerations)))
    time = time_from_start[-1]
# ---------- end vis ----------
py_6 = PythonScript(robot=plan_cartesian_motion.robot, group=plan_cartesian_motion.group, trajectory=plan_cartesian_motion.trajectory)  # -> start_configuration, configurations, full_configurations, frames, planes, fraction
# ---------- py_6: Python ----------
from compas_ghpython import draw_frame

joint_positions = []

if trajectory:
    configurations = trajectory.points
    start_configuration = trajectory.start_configuration
    fraction = trajectory.fraction
    time = trajectory.time_from_start
    full_configurations = [robot.merge_group_with_full_configuration(c, trajectory.start_configuration, group) for c in configurations]
    frames = [robot.forward_kinematics(c, group, options=dict(solver='model')) for c in full_configurations]
    planes = [draw_frame(frame) for frame in frames]
    P = [plane.Origin for plane in planes]
# ---------- end py_6 ----------
panel_21 = Panel(plan_cartesian_motion.out)
prismatic = QuickGraph(vis.P, SortOrder=0)
panel_22 = Panel("positions")
fraction = Panel(py_6.fraction)
scale_2 = Scale(Geometry=py_6.planes, Center=Point(0, 0, 0), Factor=0.001)  # -> Geometry, Transform
graph_3 = QuickGraph(vis.V, SortOrder=0)
graph_4 = QuickGraph(vis.A, SortOrder=0)
panel_23 = Panel("velocities")
pline = PolyLine(Vertices=scale_2.Geometry, Closed=False)
panel_24 = Panel("accelerations")
start = Button()
reset_2 = Button()
step = Button()
counter = CountThroughList(L=py_6.full_configurations, start=start, step=step, reset=reset_2)  # -> item; inputs L: list, start: Boolean
# ---------- counter: Python ----------
from scriptcontext import sticky as st
from compas_ghpython.utilities import update_component


interval = 1

# store data in component
guid = str(ghenv.Component.InstanceGuid)
counter_key = "counter_" + guid
running_key = "running_" + guid

if counter_key not in st:
    st[counter_key] = 0

if running_key not in st:
    st[running_key] = False

if start:
    st[running_key] = True

if step:
    if st[counter_key] < len(L) - 1:
        st[counter_key] += 1
    
if len(L):
    item = L[st[counter_key]]

if st[running_key]:
    if st[counter_key] < len(L) - 1:
        st[counter_key] += 1
        update_component(ghenv, interval)
    else:
        st[counter_key] = 0
        st[running_key] = False
# ---------- end counter ----------
preview_2 = CustomPreview(Geometry=scale_2.Geometry, Material=ColourSwatch(SwatchColor=RGB(59, 137, 161)))

# ----
filter_6 = StreamFilter(Gate=state, Stream0=forward_kinematics, Stream1=counter)
visualize = PythonScript(
    mode=list_6,
    robot=robot.robot,
    robot_name=robot_name,
    configuration=filter_6,
    group=main_planning_group,
    scale_factor=units,
    show_visual=show_visual,
    show_axes=show_axes,
    show_end_effector_frame=show_end_effector_frame)  # -> visual, axes, axes_color, ee_frame_vis, ee_color
# ---------- visualize: Python ----------
from System.Drawing import Color
from compas_ghpython.utilities import draw_pipes

from compas.geometry import Point
from compas.geometry import Vector
from compas.geometry import Translation

frames = []

size = .200 * scale_factor 
size_w = 2 * scale_factor 
radius = .008 * scale_factor
radius_w = .018 * scale_factor 

red = Color.FromArgb(255, 0, 0)
green = Color.FromArgb(0, 255, 0)
blue = Color.FromArgb(0, 0, 255)

frame_colors = [red, green, blue]


def pipes_from_frame(frame, size, radius): 
    pipes = []
    for axis in [frame.xaxis, frame.yaxis, frame.zaxis]:
        pipe = {}
        pipe['points'] = [list(frame.point), list(Point(*frame.point) + Vector(*axis) * size)]
        pipe['radius'] = radius
        pipes.append(pipe)
    return pipes


if robot and configuration and mode == 0:
    robot.update(configuration, visual=show_visual, collision=False)
    if show_visual:
        visual = robot.artist.draw_visual()
    if show_axes:
        pipes = []
        axes_color = []
        frames = robot.transformed_frames(configuration, group)
        for frame in frames:
            pipes += pipes_from_frame(frame, size, radius)
            axes_color += frame_colors
        axes = draw_pipes(pipes, cap=1)
    
    
    if show_end_effector_frame:
        frames = robot.transformed_frames(configuration, group)
        ee_frame = frames[8]
        print("End-effector", ee_frame)

        #Draw
        ee_pipes = pipes_from_frame(ee_frame, size, radius)
        ee_frame_vis = draw_pipes(ee_pipes, cap=1)
        ee_color = frame_colors
# ---------- end visualize ----------
preview_3 = CustomPreview(Geometry=visualize.axes, Shader=visualize.axes_color)
preview_4 = CustomPreview(Geometry=visualize.visual, Shader=ColourSwatch(SwatchColor=RGB(105, 105, 105)))
preview_5 = CustomPreview(Geometry=visualize.ee_frame_vis, Shader=visualize.ee_color)

multiplication = Multiplication(A=vis.time, B=4.25)

# ---- group: cartesian motion (continued)
time_sec = Panel(multiplication)

# ----
division = Division(A=time_sec, B=60)
time_min = Panel(division)

# ==== cluster Axis_setting
axis_height_from_robot_base_to_axis_base = Panel("518.046")
A = ClusterInput()
subtraction = Subtraction(A=A, B=axis_height_from_robot_base_to_axis_base)
neg = Negative(Value=subtraction)
tower = Mesh(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)
Z = UnitZ(Factor=neg)
move = Move(Geometry=tower, Motion=Z)  # -> Geometry, Transform
bbox = BoundingBox(Content=move.Geometry, Plane=PlaneXY(0, 0, 0), UnionBox=True)  # -> Box, Box_2
plate_height = Panel("165")
box = EvaluateBox(Box=bbox.Box, UParameter="0", VParameter=0.5, WParameter="0")  # -> Plane, Point, Include
box_2 = EvaluateBox(Box=bbox.Box, UParameter=0.5, VParameter=0.5, WParameter="0")  # -> Plane, Point, Include
Z_2 = UnitZ(Factor=plate_height)
rümlang_floor = Geometry(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)
rümlang = Geometry(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)
x = ClusterInput()
A_2 = ClusterInput()
A_3 = ClusterInput()
box_3 = EvaluateBox(Box=rümlang_floor, UParameter=0.5, VParameter=0.5, WParameter="0")  # -> Plane, Point, Include
xy = XYPlane(Origin=box.Point)
addition = Addition(A="561.423", B=229)
neg_2 = Negative(Value=x)
geo = Geometry([rümlang, rümlang_floor])
neg_3 = Negative(Value="2000")
division = Division(A=A_2, B=2)
vec2pt = Vector2Pt(PointA=box_2.Point, PointB=box.Point, Unitize=False)  # -> Vector, Length
subtraction_2 = Subtraction(A=x, B=addition)
xy_2 = XYPlane(Origin=box.Point)
project = Project(Geometry=box_3.Point, Plane=xy)  # -> Geometry, Transform
dom = ConstructDomain(DomainStart="2000", DomainEnd=neg_3)
amp = Amplitude(Vector=vec2pt.Vector, Amplitude=subtraction_2)
rectangle = Rectangle(Plane=xy_2, XSize=dom, YSize=dom, Radius=0)  # -> Rectangle, Length
orient = Orient(Geometry=geo, Source=box_3.Point, Target=project.Geometry)  # -> Geometry, Transform
neg_4 = Negative(Value=division)
dom_2 = ConstructDomain(DomainStart=division, DomainEnd=neg_4)
Y = ClusterInput()
F = ClusterInput()
move_2 = Move(Geometry=move.Geometry, Motion=amp)  # -> Geometry, Transform
box_4 = EvaluateBox(Box=move_2.Geometry, UParameter="0", VParameter=0.5, WParameter="0")  # -> Plane, Point, Include
box_5 = EvaluateBox(Box=move_2.Geometry, UParameter=0.5, VParameter=0.5, WParameter="0")  # -> Plane, Point, Include
vec2pt_2 = Vector2Pt(PointA=box_5.Point, PointB=box_4.Point, Unitize=False)  # -> Vector, Length
move_3 = Move(Geometry=box_4.Point, Motion=Z_2)  # -> Geometry, Transform
amp_2 = Amplitude(Vector=vec2pt_2.Vector, Amplitude=A_3)
move_4 = Move(Geometry=move_3.Geometry, Motion=amp_2)  # -> Geometry, Transform
yz = YZPlane(Origin=move_4.Geometry)
boundary = BoundarySurfaces(Edges=rectangle.Rectangle)
Y_2 = UnitY(Factor=F)
rectangle_2 = Rectangle(Plane=yz, XSize=dom_2, YSize=Y, Radius=0)  # -> Rectangle, Length
move_5 = Move(Geometry=rectangle_2.Rectangle, Motion=Y_2)  # -> Geometry, Transform
X = UnitX(Factor=Slider(700, range=0..1000))
G = ClusterInput()
X_2 = UnitX(Factor=Slider(460, range=0..1000))
geo_2 = Geometry([move_2.Geometry, orient.Geometry])
geo_3 = Geometry([move_2.Geometry, boundary])
neg_5 = Negative(Value=X)
geo_4 = Geometry(move_5.Geometry)
filter = StreamFilter(Gate=G, Stream0=geo_3, Stream1=geo_2)
mesh = MeshBrep(
    Brep=geo_4,
    Settings={GridMaxCount=0, GridMinCount=16, JaggedSeams=False, MaxEdgeLength=0, MinEdgeLength=0.0001, MinTolerance=0, Refine=True, RefineAngle=0, RelativeTolerance=0.65, SimplePlanes=True, Tolerance=0})
move_6 = Move(Geometry=geo_4, Motion=[X_2, neg_5])  # -> Geometry, Transform
geo_5 = Geometry(filter)
targetmesh = ClusterOutput(mesh)
loft = Loft(Curves=move_6.Geometry, Options={Adjust=False, Closed=False, LoftEnds=0, LoftSimp=0, LoftType=0, Rebuild=10, Refit=0.01})
env = ClusterOutput(geo_5)
cap = CapHoles(Brep=loft)
boundingbox = ClusterOutput(cap)

# ==== cluster Color
M = ClusterInput()
clean = CombineClean(Meshes=M)
mesh = Mesh(clean)
demesh = DeconstructMesh(Mesh=mesh)  # -> Vertices, Faces, Colours, Normals
lng = ListLength(List=demesh.Vertices)
pdecon = Deconstruct(Point=demesh.Vertices)  # -> XComponent, YComponent, ZComponent
series = Series(Start=0, Step=1, Count=lng)
far = ColourSwatch(SwatchColor=RGB(255, 0, 0))
close = ColourSwatch(SwatchColor=RGB(13, 0, 255))
mid = ColourSwatch(SwatchColor=RGB(255, 247, 0))
sort = SortList(Keys=pdecon.XComponent, ValuesA=series)  # -> Keys, ValuesA
range = Range(Domain=Domain(0, 1), Steps=lng)
cull_i = CullIndex(List=range, Indices=0, Wrap=True)
col = Colour([far, mid, close])
interp = InterpolateData(Data=col, Parameter=cull_i, Interpolation=2)
sort_2 = SortList(Keys=sort.ValuesA, ValuesA=interp)  # -> Keys, ValuesA
mcol = MeshColours(Mesh=mesh, Colours=sort_2.ValuesA)
mesh_2 = Mesh(mcol)
mesh_3 = ClusterOutput(mesh_2)

# ==== cluster Process_mesh
pt = ClusterInput()
G = ClusterInput()
pt_2 = Point(pt)
xy = XYPlane(Origin=Point(0, 0, 0))
yz = YZPlane(Origin=pt_2)
scale = Scale(Geometry=G, Center=Point(0, 0, 0), Factor=1000)  # -> Geometry, Transform
rad = Radians(Degrees=-90)
deplane = DeconstructPlane(Plane=xy)  # -> Origin, XAxis, YAxis, ZAxis
box = ClusterInput()
rot3d = Rotate3D(Geometry=xy, Angle=rad, Center=Point(0, 0, 0), Axis=deplane.ZAxis)  # -> Geometry, Transform
orient = Orient(Geometry=rot3d.Geometry, Source=rot3d.Geometry, Target=yz)  # -> Geometry, Transform
box_2 = Box(box)
transform = Transform(Geometry=scale.Geometry, Transform=orient.Transform)
mesh = Mesh(transform)
msplit = MeshSplit(Mesh=mesh, Splitters=box_2)
area = Area(Geometry=msplit)  # -> Area, Centroid
volume = Volume(Geometry=box_2)  # -> Volume, Centroid
dist = Distance(PointA=graft(area.Centroid), PointB=volume.Centroid)  # -> flatten(Distance)
sort = SortList(Keys=dist, ValuesA=msplit)  # -> Keys, ValuesA
item = ListItem(List=sort.ValuesA, Index=0, Wrap=True)
clean = CombineClean(Meshes=item)
mesh_2 = Mesh(clean)
demesh = DeconstructMesh(Mesh=mesh_2)  # -> Vertices, Faces, Colours, Normals
lng = ListLength(List=demesh.Vertices)
pdecon = Deconstruct(Point=demesh.Vertices)  # -> XComponent, YComponent, ZComponent
series = Series(Start=0, Step=1, Count=lng)
far = ColourSwatch(SwatchColor=RGB(255, 0, 0))
close = ColourSwatch(SwatchColor=RGB(13, 0, 255))
mid = ColourSwatch(SwatchColor=RGB(255, 247, 0))
sort_2 = SortList(Keys=pdecon.XComponent, ValuesA=series)  # -> Keys, ValuesA
range = Range(Domain=Domain(0, 1), Steps=lng)
cull_i = CullIndex(List=range, Indices=0, Wrap=True)
col = Colour([far, mid, close])
interp = InterpolateData(Data=col, Parameter=cull_i, Interpolation=2)
sort_3 = SortList(Keys=sort_2.ValuesA, ValuesA=interp)  # -> Keys, ValuesA
mcol = MeshColours(Mesh=mesh_2, Colours=sort_3.ValuesA)
M = ClusterOutput(mcol)

# ==== cluster Volume
G = ClusterInput()
volume = Volume(Geometry=G)  # -> Volume, Centroid
abs = Absolute(Value=volume.Volume)
division = Division(A=abs, B=1000000000)
R = ClusterOutput(division)
